# Dynamo graph Boundary_Create_txt_multi.dyn "Boundary_Create_txt_multi-fixed" (Dynamo 2.10.1.3976)

select_model_elements = DSModelElementsSelection()  # 1 picked in the model; graph input
current = Document.Current()
activeView = Document.ActiveView(document=current)
python_script = Python(IN[0]=select_model_elements)  # IronPython2
# ---------- python_script.python (3 lines) ----------
if isinstance(IN[0], list):
	OUT = IN[0]
else: OUT = [IN[0],IN[0]]
# ----------------------------------------
curve = DetailCurve.Curve(detailCurve=python_script)
code_block = CodeBlock { 2; }
pointsAtEqualSegmentLength = Curve.PointsAtEqualSegmentLength(curve=curve, divisions=code_block)
length = Curve.Length(curve=curve)
string = StringInput("m ")
startPoint = Curve.StartPoint(curve=curve)
X = Point.X(point=startPoint)
endPoint = Curve.EndPoint(curve=curve)
X_2 = Point.X(point=endPoint)
list_create = List.Create(item0=X, item1=X_2)
Y = Point.Y(point=startPoint)
Y_2 = Point.Y(point=endPoint)
list_create_2 = List.Create(item0=Y, item1=Y_2)

# group: tolerances
round_to_1 = CodeBlock { 59.9; }
round_to_0 = CodeBlock { 0.4; }

angle_text = Python(IN[0]=list_create, IN[1]=list_create_2, IN[2]=round_to_1, IN[3]=round_to_0)  # IronPython2
# ---------- angle_text.python (50 lines) ----------
import math

from math import atan2,degrees

x = IN[0]
y = IN[1]
acc_max = IN[2]
acc_min = IN[3]

def AngleBtw2Points(pointA, pointB):
  changeInX = x[1][i] - x[0][i]
  changeInY = y[1][i] - y[0][i]
  return degrees(atan2(changeInY,changeInX)) #remove degrees if you want your answer in radians
d = []
for i in range(0, len(x[0])):
	d.append(AngleBtw2Points(x,y))


def dd_to_dms(degs):
    neg = degs < 0
    degs = (-1) ** neg * degs
    degs, d_int = math.modf(degs)
    mins, m_int = math.modf(60 * degs)
    secs        =           60 * mins
    
    if secs > acc_max:
    	secs = 0
    	m_int = m_int + 1
    
    if m_int > acc_max:
    	m_int = 0
    	d_int = d_int+1
  
    if secs < acc_min:
    	secs = 0
    
    if m_int < acc_min:
    	m_int = 0

    if d_int < acc_min:
    	d_int = 0
    	
    return neg, d_int, m_int, secs

ss = []
for i in range(0, len(x[0])):
	ss.append(dd_to_dms(d[i]))


OUT = ss
# ----------------------------------------
string_2 = StringInput("°")
string_3 = StringInput("'")
string_4 = StringInput("\"")
python_script_2 = Python(IN[0]=length, IN[1]=string, IN[2]=angle_text, IN[3]=string_2, IN[4]=string_3, IN[5]=string_4)  # IronPython2
# ---------- python_script_2.python (12 lines) ----------
import math

fff = []

for i in range(0,len(IN[0])):
	z = str(round(IN[0][i]/10)*10/1000)
	an = str(IN[2][i][1]).split(".")[0]
	an2 = str(IN[2][i][2]).split(".")[0]
	an3 = str(IN[2][i][3]).split(".")[0]
	fff.append(z + IN[1] + an + IN[3]+an2+IN[4]+an3+IN[5])

OUT = fff
# ----------------------------------------
code_block_2 = CodeBlock { "Center"; }

# group: FONT
code_block_3 = CodeBlock { "2.5mm Arial"; }

family_type_by_name = Python(IN[0]=code_block_3)  # IronPython2
# ---------- family_type_by_name.python (50 lines) ----------
import clr

clr.AddReference('RevitAPI')
from Autodesk.Revit.DB import *
from Autodesk.Revit.DB.Structure import *

clr.AddReference('RevitAPIUI')
from Autodesk.Revit.UI import *

clr.AddReference('System')
from System.Collections.Generic import List

clr.AddReference('RevitNodes')
import Revit
clr.ImportExtensions(Revit.GeometryConversion)
clr.ImportExtensions(Revit.Elements)

clr.AddReference('RevitServices')
import RevitServices
from RevitServices.Persistence import DocumentManager
from RevitServices.Transactions import TransactionManager

doc = DocumentManager.Instance.CurrentDBDocument
uidoc=DocumentManager.Instance.CurrentUIApplication.ActiveUIDocument


#Do some action in a Transaction
TransactionManager.Instance.EnsureInTransaction(doc)


famTypes = FilteredElementCollector(doc).OfClass(TextNoteType).ToElements()

TransactionManager.Instance.TransactionTaskDone()

x = []
for i in famTypes: 
	x.append(i.LookupParameter("Type Name").AsString())

f = []
for i in range(0,len(x)): f.append(IN[0] in x[i])

g = zip(famTypes,f)
v = []
for i in range(0,len(g)):
	if g[i][1] == True: v.append(g[i][0])
h = []
if len(v)>0: h = v[0]
else: h = famTypes[0]

OUT = h
# ----------------------------------------
angle = Python(IN[0]=list_create, IN[1]=list_create_2)  # IronPython2
# ---------- angle.python (13 lines) ----------
from math import atan2,degrees
x = IN[0]
y = IN[1]

def AngleBtw2Points(pointA, pointB):
  changeInX = x[1][i] - x[0][i]
  changeInY = y[1][i] - y[0][i]
  return degrees(atan2(changeInY,changeInX)) #remove degrees if you want your answer in radians
d = []
for i in range(0, len(x[0])):
	d.append(AngleBtw2Points(x,y))

OUT = d
# ----------------------------------------
byLocation = TextNote.ByLocation(view=activeView, location=pointsAtEqualSegmentLength, text=python_script_2, alignment=code_block_2, type=family_type_by_name, rotation=angle)
python_script_3 = Python(IN[0]=select_model_elements, IN[1]=byLocation)  # IronPython2
# ---------- python_script_3.python (3 lines) ----------
if isinstance(IN[0], list):
	x = []
else: OUT = IN[1][0]
# ----------------------------------------
delete = Element.Delete()  # unwired: element
