# Dynamo graph Family_DELETE.dyn (Dynamo 2.6.1.8786)

select_model_elements = DSModelElementsSelection()  # 1 picked in the model; graph input
get_type_family = Python(IN[0]=select_model_elements)
# ---------- get_type_family.python (24 lines) ----------
import clr

clr.AddReference("RevitServices")
import RevitServices
from RevitServices.Persistence import DocumentManager
from RevitServices.Transactions import TransactionManager
doc =  DocumentManager.Instance.CurrentDBDocument
app = DocumentManager.Instance.CurrentUIApplication.Application

clr.AddReference("RevitAPI")
from Autodesk.Revit.DB import *



f = IN[0]

x = []

if isinstance(f, list): 
	for i in f:
		x.append(i.Type.Family)
else: x.append(f.Type.Family)

OUT = x
# ----------------------------------------
delete = Element.Delete(element=get_type_family)
