# Dynamo graph Fill_Area.dyn (Dynamo 2.6.1.8786)

select_model_element = DSModelElementSelection()  # 1 picked in the model; graph input
code_block = CodeBlock { "Area"; }
getParameterValueByName = Element.GetParameterValueByName(element=select_model_element, parameterName=code_block)
code_block_2 = CodeBlock { 1000000; }
mul = getParameterValueByName * code_block_2
pop_up_message = Python(IN[0]=mul)
# ---------- pop_up_message.python (16 lines) ----------
#This script pops up a dialog box with a message from the previous node.
import clr
clr.AddReference('RevitAPIUI')

from Autodesk.Revit.UI import TaskDialog

mainText = IN[0]
xx = str(mainText).split(".")[0]


messagePop = TaskDialog("Dynamo Player")
messagePop.MainContent = "area is " +xx + " mm^2 or "+ str(mainText/1000000) +  "m^2" ;

OUT = "Success!"

messagePop.Show()
# ----------------------------------------
