# Dynamo graph Fill_Centroid.dyn (Dynamo 2.10.1.3976)

current = Document.Current()
activeView = Document.ActiveView(document=current)
select_model_element = DSModelElementSelection()  # 1 picked in the model; graph input
boolean = BoolSelector(false)
boolean_2 = BoolSelector(true)
element_sketch = Python(IN[0]=select_model_element, IN[1]=boolean, IN[2]=boolean_2)  # IronPython2
# ---------- element_sketch.python (90 lines) ----------
#Copyright(c) 2016, Dimitar Venkov
# @5devene, dimitar.ven@gmail.com

import clr
import math

clr.AddReference("RevitServices")
import RevitServices
from RevitServices.Persistence import DocumentManager
from RevitServices.Transactions import TransactionManager
doc = DocumentManager.Instance.CurrentDBDocument

clr.AddReference("RevitNodes")
import Revit
clr.ImportExtensions(Revit.Elements)
clr.ImportExtensions(Revit.GeometryConversion)

clr.AddReference("RevitAPI")
from Autodesk.Revit.DB import *

def tolist(obj1):
	if hasattr(obj1,"__iter__"): return obj1
	else: return [obj1]

elements = UnwrapElement(tolist(IN[0]))
getModel = IN[1]

accepted_mc = "Autodesk.Revit.DB.ModelLine, Autodesk.Revit.DB.ModelArc, Autodesk.Revit.DB.ModelEllipse, Autodesk.Revit.DB.ModelHermiteSpline, Autodesk.Revit.DB.ModelNurbSpline"

def almost_eq(line, mc):
	line2 = mc.Location.Curve
	xyz1 = line.Evaluate(0.5, True)
	if not line2.IsBound:
		xyz2 = line2.Center
		try: xyz1 = line.Center
		except: pass
	else:
		xyz2 = line2.Evaluate(0.5, True)
	if xyz1.DistanceTo(xyz2) <= 0.0001:
		return True
	else:
		return False

def clean1(l1):
	for i in xrange(len(l1) ):
		l1[i] = [x for x in l1[i] if x != None]
	return l1

def getSketch(el1):
	try:
		sk1 = doc.GetElement(ElementId(el1.Id.IntegerValue - 1) )
	except:
		sk1 = None
	if not getModel and sk1 is not None and sk1.GetType().ToString() == 'Autodesk.Revit.DB.Sketch':
		profile = sk1.Profile
	else:
		t1 = SubTransaction(doc)
		t1.Start()
		deleted = doc.Delete(el1.Id)
		t1.RollBack()
		
		profile, mc = CurveArrArray(), []
		for d in deleted:
			test_el = doc.GetElement(d)
			el_type = test_el.GetType().ToString()
			if el_type == "Autodesk.Revit.DB.Sketch":
				profile = test_el.Profile
				if not getModel:
					break
			elif getModel and el_type in accepted_mc :
				mc.append(test_el)

	ordered_mc = [ [None] * i.Size for i in profile] if getModel else []
	curves = [ [None] * i.Size for i in profile]
	for i in xrange(profile.Size):
		for j in xrange(profile[i].Size):
			curves[i][j] = profile[i][j].ToProtoType()
			if getModel:
				for k in xrange(len(mc)):
					if almost_eq(profile[i][j], mc[k]):
						ordered_mc[i][j] = mc[k].ToDSType(True)
						del mc[k]
						break
						
	return curves, clean1(ordered_mc)

TransactionManager.Instance.EnsureInTransaction(doc)
result = map(getSketch, elements)
TransactionManager.Instance.TransactionTaskDone()
OUT = [r[0] for r in result], [r[1] for r in result]
# ----------------------------------------
flatten = List.Flatten(list=element_sketch)
watch = Watch(flatten)
byJoinedCurves = PolyCurve.ByJoinedCurves(curves=watch)
code_block = CodeBlock { 1000; }
extrudeAsSolid = Curve.ExtrudeAsSolid(curve=byJoinedCurves, distance=code_block)
centroid = Solid.Centroid(solid=extrudeAsSolid)
X = Point.X(point=centroid)
code_block_2 = CodeBlock { 500; }
add = X + code_block_2
Y = Point.Y(point=centroid)
add_2 = Y + code_block_2
Z = Point.Z(point=centroid)
add_3 = Z + code_block_2
byCoordinates = Point.ByCoordinates(x=add, y=add_2, z=add_3)
byStartPointEndPoint = Line.ByStartPointEndPoint(startPoint=centroid, endPoint=byCoordinates)
code_block_3 = CodeBlock { -500; }
add_4 = X + code_block_3
add_5 = Y + code_block_2
add_6 = Z + code_block_2
byCoordinates_2 = Point.ByCoordinates(x=add_4, y=add_5, z=add_6)
byStartPointEndPoint_2 = Line.ByStartPointEndPoint(startPoint=centroid, endPoint=byCoordinates_2)
code_block_4 = CodeBlock { 50; }
byCenterPointRadius = Circle.ByCenterPointRadius(centerPoint=centroid, radius=code_block_4)
list_create = List.Create(item0=byStartPointEndPoint, item1=byStartPointEndPoint_2, item2=byCenterPointRadius)
byCurve = DetailCurve.ByCurve(view=activeView, curve=list_create)
