# Dynamo graph Fill_Perimeter.dyn (Dynamo 2.6.1.8786)

select_model_element = DSModelElementSelection()  # 1 picked in the model; graph input
python_script = Python(IN[0]=select_model_element)
# ---------- python_script.python (40 lines) ----------
import clr
clr.AddReference('ProtoGeometry')
from Autodesk.DesignScript.Geometry import *

clr.AddReference('RevitAPI')
import Autodesk
from Autodesk.Revit.DB import *

import clr

clr.AddReference('RevitNodes')
import Revit

# Import ToProtoType, ToRevitType geometry conversion extension methods
clr.ImportExtensions(Revit.GeometryConversion)

#The inputs to this node will be stored as a list in the IN variables.
element = IN[0]

result = None

revitElement = element.InternalElement

edges = []
lineStyleIds = []

if type(element.InternalElement) == FilledRegion:
  filledRegion = revitElement
  geometryElement = filledRegion.get_Geometry(Options())
  geometryObjects = list(geometryElement)
  for geometryObject in geometryObjects:
    if type(geometryObject) == Solid:
      solid = geometryObject
      edges.extend(e.AsCurve().ToProtoType() for e in solid.Edges)
      lineStyleIds.extend(e.GraphicsStyleId for e in solid.Edges)
    else:
      raise Exception("FilledRegion: has non-Solid geometry!")

#Assign your output to the OUT variable.
OUT = edges, lineStyleIds
# ----------------------------------------
flatten = List.Flatten(list=python_script)
code_block = CodeBlock { 1; }
getItemAtIndex = List.GetItemAtIndex(list=python_script, index=code_block)
code_block_2 = CodeBlock { "Boundary"; }
code_block_3 = CodeBlock(a=getItemAtIndex, b=code_block_2) { a==b; }
filterByBoolMask = List.FilterByBoolMask(list=flatten, mask=code_block_3)
length = Curve.Length(curve=filterByBoolMask.out)
sum = Math.Sum(values=length)
watch = Watch(sum)  # graph output
pop_up_message = Python(IN[0]=watch)
# ---------- pop_up_message.python (16 lines) ----------
#This script pops up a dialog box with a message from the previous node.
import clr
clr.AddReference('RevitAPIUI')

from Autodesk.Revit.UI import TaskDialog

mainText = IN[0]
xx = str(mainText).split(".")[0]


messagePop = TaskDialog("Dynamo Player")
messagePop.MainContent = "total perimeter length is " +xx + " mm or "+ str(mainText/1000) +  "m" ;

OUT = "Success!"

messagePop.Show()
# ----------------------------------------
