# Dynamo graph Framing Disallow Structural  Joins.dyn "Framing Disallow Structural Joins" (Dynamo 2.10.1.3976)

disallow = BoolSelector(true)  # graph input
code_block = CodeBlock { "Disallowed"; "Allowed"; }
if_ = If(test=disallow, true=code_block.out0, false=code_block.out1)
select_model_elements = DSModelElementsSelection()  # 2 picked in the model
python_script = Python(IN[0]=select_model_elements, IN[1]=disallow)  # IronPython2
# ---------- python_script.python (63 lines) ----------
# This node has been made by Modelical
# www.modelical.com

import clr
clr.AddReference('ProtoGeometry')
from Autodesk.DesignScript.Geometry import *

#Load Dynamo wrappers
clr.AddReference("RevitNodes")
import Revit
from Revit.Elements import *
clr.ImportExtensions(Revit.GeometryConversion)
clr.ImportExtensions(Revit.Elements)

#Load Revit API
clr.AddReference('RevitAPI')
from Autodesk.Revit.DB import *
from Autodesk.Revit.DB.Structure import *
import Autodesk

#Load document reference
clr.AddReference("RevitServices")
import RevitServices
from RevitServices.Persistence import DocumentManager
from RevitServices.Transactions import TransactionManager

doc = DocumentManager.Instance.CurrentDBDocument
uiapp = DocumentManager.Instance.CurrentUIApplication
app = uiapp.Application

def toList(input):
	if isinstance(input,list) == False:
		return [input]
	else:
		return input

def flatten(x):
    result = []
    for el in x:
        if hasattr(el, "__iter__") and not isinstance(el, basestring):
            result.extend(flatten(el))
        else:
            result.append(el)
    return result

strFraming = flatten(toList(UnwrapElement(IN[0])))
disallowed = IN[1]

if disallowed:
	TransactionManager.Instance.EnsureInTransaction(doc)
	for strF in strFraming:
		StructuralFramingUtils.DisallowJoinAtEnd(strF,0)
		StructuralFramingUtils.DisallowJoinAtEnd(strF,1)
	TransactionManager.Instance.TransactionTaskDone()

else:
	TransactionManager.Instance.EnsureInTransaction(doc)
	for strF in strFraming:
		StructuralFramingUtils.AllowJoinAtEnd(strF,0)
		StructuralFramingUtils.AllowJoinAtEnd(strF,1)
	TransactionManager.Instance.TransactionTaskDone()

OUT = strFraming
# ----------------------------------------
