# Dynamo graph Framing_Align_Horizontal.dyn (Dynamo 2.10.1.3976)

elements_to_align = DSModelElementsSelection()  # 2 picked in the model; graph input
select_example = DSModelElementSelection()  # 1 picked in the model; graph input

# group: disallow joints
disallow = BoolSelector(true)
python_script = Python(IN[0]=select_example, IN[1]=disallow)  # IronPython2
# ---------- python_script.python (63 lines) ----------
# This node has been made by Modelical
# www.modelical.com

import clr
clr.AddReference('ProtoGeometry')
from Autodesk.DesignScript.Geometry import *

#Load Dynamo wrappers
clr.AddReference("RevitNodes")
import Revit
from Revit.Elements import *
clr.ImportExtensions(Revit.GeometryConversion)
clr.ImportExtensions(Revit.Elements)

#Load Revit API
clr.AddReference('RevitAPI')
from Autodesk.Revit.DB import *
from Autodesk.Revit.DB.Structure import *
import Autodesk

#Load document reference
clr.AddReference("RevitServices")
import RevitServices
from RevitServices.Persistence import DocumentManager
from RevitServices.Transactions import TransactionManager

doc = DocumentManager.Instance.CurrentDBDocument
uiapp = DocumentManager.Instance.CurrentUIApplication
app = uiapp.Application

def toList(input):
	if isinstance(input,list) == False:
		return [input]
	else:
		return input

def flatten(x):
    result = []
    for el in x:
        if hasattr(el, "__iter__") and not isinstance(el, basestring):
            result.extend(flatten(el))
        else:
            result.append(el)
    return result

strFraming = flatten(toList(UnwrapElement(IN[0])))
disallowed = IN[1]

if disallowed:
	TransactionManager.Instance.EnsureInTransaction(doc)
	for strF in strFraming:
		StructuralFramingUtils.DisallowJoinAtEnd(strF,0)
		StructuralFramingUtils.DisallowJoinAtEnd(strF,1)
	TransactionManager.Instance.TransactionTaskDone()

else:
	TransactionManager.Instance.EnsureInTransaction(doc)
	for strF in strFraming:
		StructuralFramingUtils.AllowJoinAtEnd(strF,0)
		StructuralFramingUtils.AllowJoinAtEnd(strF,1)
	TransactionManager.Instance.TransactionTaskDone()

OUT = IN[0]
# ----------------------------------------
code_block = CodeBlock { "Disallowed"; "Allowed"; }
if_ = If(test=disallow, true=code_block.out0, false=code_block.out1)

watch = Watch(python_script)
getLocation = Element.GetLocation(element=python_script)
startPoint = Curve.StartPoint(curve=getLocation)
direction = Line.Direction(line=getLocation)
watch_2 = Watch(python_script)
string = StringInput("Start Extension")
getParameterValueByName = Element.GetParameterValueByName(element=watch_2, parameterName=string)
code_block_2 = CodeBlock(x=getParameterValueByName) { -x; }
translate = Geometry.Translate(geometry=startPoint, direction=direction, distance=code_block_2)
length = Curve.Length(curve=getLocation)
add = length + getParameterValueByName
watch_3 = Watch(python_script)
string_2 = StringInput("End Extension")
getParameterValueByName_2 = Element.GetParameterValueByName(element=watch_3, parameterName=string_2)
add_2 = add + getParameterValueByName_2
byStartPointDirectionLength = Line.ByStartPointDirectionLength(startPoint=translate, direction=direction, length=add_2)
passthrough = Python(IN[0]=watch, IN[1]=byStartPointDirectionLength)  # IronPython2
# ---------- passthrough.python (7 lines) ----------
d = IN[0]
p = IN[1]

if p is not None: out = d
else: out = "wait"

OUT = out
# ----------------------------------------

# group: final element
string_3 = StringInput("Start Extension")
code_block_3 = CodeBlock { 0; }
setParameterByName = Element.SetParameterByName(element=passthrough, parameterName=string_3, value=code_block_3)
string_4 = StringInput("End Extension")
code_block_4 = CodeBlock { 0; }
setParameterByName_2 = Element.SetParameterByName(element=passthrough, parameterName=string_4, value=code_block_4)
setLocation = Element.SetLocation(element=passthrough, geometry=byStartPointDirectionLength)

# group: target object
getLocation_2 = Element.GetLocation(element=setParameterByName)
startPoint_2 = Curve.StartPoint(curve=getLocation_2)
direction_2 = Line.Direction(line=getLocation_2)
length_2 = Curve.Length(curve=getLocation_2)

X = Point.X(point=startPoint_2)
X_2 = Vector.X(vector=direction_2)
selector = Python(IN[0]=X, IN[1]=X_2)  # IronPython2
# ---------- selector.python (7 lines) ----------
x_in = IN[0]
x_dir = IN[1]


if x_dir>0:
	OUT = x_in
else: OUT =0
# ----------------------------------------
Y = Point.Y(point=startPoint_2)
Y_2 = Vector.Y(vector=direction_2)
selector_2 = Python(IN[0]=Y, IN[1]=Y_2)  # IronPython2; same code as selector
Z = Point.Z(point=startPoint_2)
Z_2 = Vector.Z(vector=direction_2)
selector_3 = Python(IN[0]=Z, IN[1]=Z_2)  # IronPython2; same code as selector

# group: what to align
getLocation_3 = Element.GetLocation(element=elements_to_align)
startPoint_3 = Curve.StartPoint(curve=getLocation_3)
direction_3 = Line.Direction(line=getLocation_3)

X_3 = Point.X(point=startPoint_3)
flatten = List.Flatten(list=X_3)
Y_3 = Point.Y(point=startPoint_3)
flatten_2 = List.Flatten(list=Y_3)
Z_3 = Point.Z(point=startPoint_3)
flatten_3 = List.Flatten(list=Z_3)
selector_4 = Python(IN[0]=selector, IN[1]=selector_2, IN[2]=selector_3, IN[3]=flatten, IN[4]=flatten_2, IN[5]=flatten_3)  # IronPython2
# ---------- selector_4.python (24 lines) ----------
import clr
clr.AddReference('ProtoGeometry')
from Autodesk.DesignScript.Geometry import *

x = IN[0]
y = IN[1]
z = IN[2]

x_=IN[3]
y_ = IN[4]
z_ = IN[5]


outlist = []

for i in range(len(x_)):
	if x!=0 and y==0 and z==0:
		outlist.append(Point.ByCoordinates(x,y_[i],z_[i]))
	if y!=0 and x==0 and z==0:
		outlist.append(Point.ByCoordinates(x_[i],y,z_[i]))
	if z!=0 and x==0 and y==0:
		outlist.append(Point.ByCoordinates(x_[i],y_[i],z))
	
OUT = outlist
# ----------------------------------------
byStartPointDirectionLength_2 = Line.ByStartPointDirectionLength(startPoint=selector_4, direction=direction_3, length=length_2)
setLocation_2 = Element.SetLocation(element=elements_to_align, geometry=byStartPointDirectionLength_2)

# group: round
passthrough_2 = Python(IN[0]=elements_to_align, IN[1]=byStartPointDirectionLength_2)  # IronPython2; same code as passthrough
string_5 = StringInput("End Extension")
code_block_5 = CodeBlock { 0; }
setParameterByName_3 = Element.SetParameterByName(element=passthrough_2, parameterName=string_5, value=code_block_5)
string_6 = StringInput("Start Extension")
code_block_6 = CodeBlock { 0; }
setParameterByName_4 = Element.SetParameterByName(element=passthrough_2, parameterName=string_6, value=code_block_6)
