# Dynamo graph Framing_Ext_to_Length.dyn (Dynamo 2.10.1.3976)

select_model_elements = DSModelElementsSelection()  # 1 picked in the model

# group: disallow joints
disallow = BoolSelector(true)  # graph input
python_script = Python(IN[0]=select_model_elements, IN[1]=disallow)  # IronPython2
# ---------- python_script.python (63 lines) ----------
# This node has been made by Modelical
# www.modelical.com

import clr
clr.AddReference('ProtoGeometry')
from Autodesk.DesignScript.Geometry import *

#Load Dynamo wrappers
clr.AddReference("RevitNodes")
import Revit
from Revit.Elements import *
clr.ImportExtensions(Revit.GeometryConversion)
clr.ImportExtensions(Revit.Elements)

#Load Revit API
clr.AddReference('RevitAPI')
from Autodesk.Revit.DB import *
from Autodesk.Revit.DB.Structure import *
import Autodesk

#Load document reference
clr.AddReference("RevitServices")
import RevitServices
from RevitServices.Persistence import DocumentManager
from RevitServices.Transactions import TransactionManager

doc = DocumentManager.Instance.CurrentDBDocument
uiapp = DocumentManager.Instance.CurrentUIApplication
app = uiapp.Application

def toList(input):
	if isinstance(input,list) == False:
		return [input]
	else:
		return input

def flatten(x):
    result = []
    for el in x:
        if hasattr(el, "__iter__") and not isinstance(el, basestring):
            result.extend(flatten(el))
        else:
            result.append(el)
    return result

strFraming = flatten(toList(UnwrapElement(IN[0])))
disallowed = IN[1]

if disallowed:
	TransactionManager.Instance.EnsureInTransaction(doc)
	for strF in strFraming:
		StructuralFramingUtils.DisallowJoinAtEnd(strF,0)
		StructuralFramingUtils.DisallowJoinAtEnd(strF,1)
	TransactionManager.Instance.TransactionTaskDone()

else:
	TransactionManager.Instance.EnsureInTransaction(doc)
	for strF in strFraming:
		StructuralFramingUtils.AllowJoinAtEnd(strF,0)
		StructuralFramingUtils.AllowJoinAtEnd(strF,1)
	TransactionManager.Instance.TransactionTaskDone()

OUT = IN[0]
# ----------------------------------------
code_block = CodeBlock { "Disallowed"; "Allowed"; }
if_ = If(test=disallow, true=code_block.out0, false=code_block.out1)

watch = Watch(python_script)
getLocation = Element.GetLocation(element=python_script)
startPoint = Curve.StartPoint(curve=getLocation)
direction = Line.Direction(line=getLocation)
watch_2 = Watch(python_script)
string = StringInput("Start Extension")
getParameterValueByName = Element.GetParameterValueByName(element=watch_2, parameterName=string)
code_block_2 = CodeBlock(x=getParameterValueByName) { -x; }
translate = Geometry.Translate(geometry=startPoint, direction=direction, distance=code_block_2)
length = Curve.Length(curve=getLocation)
add = length + getParameterValueByName
watch_3 = Watch(python_script)
string_2 = StringInput("End Extension")
getParameterValueByName_2 = Element.GetParameterValueByName(element=watch_3, parameterName=string_2)
add_2 = add + getParameterValueByName_2
byStartPointDirectionLength = Line.ByStartPointDirectionLength(startPoint=translate, direction=direction, length=add_2)
passthrough = Python(IN[0]=watch, IN[1]=byStartPointDirectionLength)  # IronPython2
# ---------- passthrough.python (7 lines) ----------
d = IN[0]
p = IN[1]

if p is not None: out = d
else: out = "wait"

OUT = out
# ----------------------------------------

# group: final element
setLocation = Element.SetLocation(element=passthrough, geometry=byStartPointDirectionLength)
string_3 = StringInput("Start Extension")
code_block_3 = CodeBlock { 0; }
setParameterByName = Element.SetParameterByName(element=passthrough, parameterName=string_3, value=code_block_3)
string_4 = StringInput("End Extension")
code_block_4 = CodeBlock { 0; }
setParameterByName_2 = Element.SetParameterByName(element=passthrough, parameterName=string_4, value=code_block_4)
