# Dynamo graph Grids_switch_bubbles.dyn (Dynamo 2.6.1.8786)

select_model_elements = DSModelElementsSelection()  # 4 picked in the model
watch = Watch(select_model_elements)
string_from_object = FromObject(obj=watch)
string = StringInput("Grid")
grid_only = Python(IN[0]=string_from_object, IN[1]=string, IN[2]=watch)
# ---------- grid_only.python (11 lines) ----------
output = []
output2 = []

for i in IN[0]:
	if IN[1] in i: output.append(True)
	else: output.append(False)

for i in range(len(IN[0])):
	if output[i] == True: output2.append(IN[2][i])
	
OUT = output2	
# ----------------------------------------
watch_2 = Watch(grid_only)
list_create = List.Create(item0=watch_2)
current = Document.Current()
activeView = Document.ActiveView(document=current)
list_create_2 = List.Create(item0=activeView)
grid_bubble_on_or_off = Python(IN[0]=watch_2, IN[1]=list_create_2)
# ---------- grid_bubble_on_or_off.python (29 lines) ----------
import clr
clr.AddReference('RevitAPI')
from Autodesk.Revit.DB import *
import Autodesk

clr.AddReference("RevitServices")
import RevitServices
from RevitServices.Persistence import DocumentManager
from RevitServices.Transactions import TransactionManager

items = UnwrapElement (IN[0])
view = UnwrapElement (IN[1])

Gridend0 = []
Gridend1 = []

for i in items:
	if i.IsBubbleVisibleInView(DatumEnds.End0, view[0]):
		Gridend0.append(1)
	else:
		Gridend0.append(0)

for i in items:
	if i.IsBubbleVisibleInView(DatumEnds.End1, view[0]):
		Gridend1.append(1)
	else:
		Gridend1.append(0)

OUT = Gridend0,Gridend1
# ----------------------------------------
code_block = CodeBlock { 1; }
getItemAtIndex = List.GetItemAtIndex(list=grid_bubble_on_or_off, index=code_block)
code_block_2 = CodeBlock { 0; }
getItemAtIndex_2 = List.GetItemAtIndex(list=grid_bubble_on_or_off, index=code_block_2)
grids_to_to_revert = Python(IN[0]=list_create, IN[1]=list_create_2, IN[2]=getItemAtIndex, IN[3]=getItemAtIndex_2)
# ---------- grids_to_to_revert.python (50 lines) ----------
# import common language runtime and libraries
import clr
clr.AddReference('RevitAPI')
from Autodesk.Revit.DB import *
import Autodesk

clr.AddReference("RevitServices")
import RevitServices
from RevitServices.Persistence import DocumentManager
from RevitServices.Transactions import TransactionManager

doc = DocumentManager.Instance.CurrentDBDocument

# inputs in variables
items = UnwrapElement (IN[0])
view = UnwrapElement (IN[1])
gridend = IN[2]
gridend1 = IN[3]

# define function to turn on/off bubbles according to template
def bubbleHead(views, grids, template, side):
	# loop through all views in the views list
	for v in views:
		# counters to select correct items
		j = 0
		i = 0	
		# loop through all grids inside view
		for grid in grids[j]:
			# set bubble visibility according to template
			if template[i] == 0:
				grid.HideBubbleInView(side, v)
			else:
				grid.ShowBubbleInView(side, v)
			# increase the counter for template to match next grid in view
			i += 1
		# increase counter to match next set of grids to view
		j += 1

# open transaction manager
TransactionManager.Instance.EnsureInTransaction(doc)

# call function with first set of parameters
one = bubbleHead(view, items, gridend, DatumEnds.End0)
# call function with second set of parameters
two = bubbleHead(view, items, gridend1, DatumEnds.End1)

# end transcation
TransactionManager.Instance.TransactionTaskDone()

OUT = 0
# ----------------------------------------
