# Dynamo graph Lines.Length.dyn (Dynamo 2.6.1.8786)

select_model_elements = DSModelElementsSelection()  # 4 picked in the model
input_check = Python(IN[0]=select_model_elements)
# ---------- input_check.python (8 lines) ----------
input = IN[0]
elements = []

if isinstance(input, list): 
	for i in input:	elements.append(i)
else: elements = [input]
		
OUT = elements
# ----------------------------------------
code_block = CodeBlock { "Length"; }
parameterByName = Parameter.ParameterByName(element=input_check, name=code_block)
watch = Watch(parameterByName)
string_from_object = FromObject(obj=watch)
null_check = Python(IN[0]=string_from_object)
# ---------- null_check.python (9 lines) ----------
input = IN[0]
elements = []

for i in input:
	if i != "null" or "none": 
		elements.append(i)

		
OUT = elements
# ----------------------------------------
python_script = Python(IN[0]=null_check)
# ---------- python_script.python (9 lines) ----------
x = IN[0]

y = []
for i in x:
	y.append(float(i[9:]))
# Place your code below this line

# Assign your output to the OUT variable.
OUT = sum(y)
# ----------------------------------------
watch_2 = Watch(python_script)
pop_up_message = Python(IN[0]=watch_2)
# ---------- pop_up_message.python (15 lines) ----------
#This script pops up a dialog box with a message from the previous node.
import clr
clr.AddReference('RevitAPIUI')

from Autodesk.Revit.UI import TaskDialog

mainText = IN[0]


messagePop = TaskDialog("Dynamo Player")
messagePop.MainContent = "total length is " +str(mainText) + " mm or "+ str(mainText/1000) +  "m" ;

OUT = "Success!"

messagePop.Show()
# ----------------------------------------
code_block_2 = CodeBlock { "Length"; }
parameterByName_2 = Parameter.ParameterByName(element=input_check, name=code_block_2)
