# Dynamo graph Open_ext_ref.dyn "123" (Dynamo 2.6.1.8786)
# packages: bimorphNodes 3.0.3

boolean = BoolSelector(true)
reportInstances = CAD.ReportInstances(refresh=boolean)
watch = Watch(reportInstances.report)
code_block = CodeBlock { 0; }
getItemAtIndex = List.GetItemAtIndex(list=watch, index=code_block, lacing=Longest)
select_model_element = DSModelElementSelection()  # 1 picked in the model; graph input
contains = List.Contains(list=getItemAtIndex, item=select_model_element, lacing=Longest)
filterByBoolMask = List.FilterByBoolMask(list=watch, mask=contains)
code_block_2 = CodeBlock { 7; }
getItemAtIndex_2 = List.GetItemAtIndex(list=filterByBoolMask.in, index=code_block_2, lacing=Longest)
firstItem = List.FirstItem(list=getItemAtIndex_2)
run = BoolSelector(true)
software_path = StringInput("C:\Windows\System32\notepad.exe")
string = StringInput("C:\Program Files\Common Files\Autodesk Shared\AcShellEx\AcLauncher.exe")
string_2 = StringInput("C:\Program Files\Microsoft Office 15\root\office15\EXCEL.EXE")
programs_to_open = Python(IN[0]=firstItem, IN[1]=software_path, IN[2]=string, IN[3]=string_2)
# ---------- programs_to_open.python (17 lines) ----------
name = IN[0]

x = name.find('.txt',1)
SPath=[]
if x>0: SPath = str(IN[1])
else:
	x = name.find('.dwg',1)
	SPath=[]
	if x>0: SPath = str(IN[2])
	else: 
		x = name.find('.xlsx',1)
		SPath=[]
		if x>0: SPath = str(IN[3])
		else:'error'


OUT = SPath
# ----------------------------------------
file_open = Python(IN[0]=firstItem, IN[1]=run, IN[2]=programs_to_open)
# ---------- file_open.python (28 lines) ----------
# Load the Python Standard and DesignScript Libraries
import sys
import clr
import os
import subprocess
#clr.AddReference('ProtoGeometry')
#from Autodesk.DesignScript.Geometry import *

# The inputs to this node will be stored as a list in the IN variables.
#dataEnteringNode = IN

# Place your code below this line


txt1 = IN[0]
#txt1 = 'C:\1.txt'
bool = IN[1]


#SPath = r'C:\Windows\System32\notepad.exe'
SPath = str(IN[2])

if bool:
	subprocess.Popen([SPath, txt1])

#subprocess.Popen('explorer "C:\temp"') #itWorks!
# Assign your output to the OUT variable.
#OUT = 0
# ----------------------------------------
test = Python(IN[0]=select_model_element)
# ---------- test.python (25 lines) ----------
import clr

clr.AddReference('RevitServices')
import RevitServices
from RevitServices.Persistence import DocumentManager
from RevitServices.Transactions import TransactionManager
doc = DocumentManager.Instance.CurrentDBDocument

clr.AddReference('RevitNodes')
import Revit
clr.ImportExtensions(Revit.Elements)
clr.ImportExtensions(Revit.GeometryConversion)

clr.AddReference('RevitAPI')
from Autodesk.Revit.DB import *


data = UnwrapElement(IN[0])




z = data.GetExternalFileReference

OUT = z
# ----------------------------------------
