# Dynamo graph Print_Current.dyn (Dynamo 2.10.1.3976)

# group: get the selected sheets if any
select_model_elements = Python()  # IronPython2; unwired: IN[0]
# ---------- select_model_elements.python (27 lines) ----------
import clr
clr.AddReference('RevitNodes')
import Revit
clr.ImportExtensions(Revit.GeometryConversion)

clr.AddReference('RevitAPI')
import Autodesk
from Autodesk.Revit.DB import *

clr.AddReference("RevitServices")
import RevitServices
from RevitServices.Persistence import DocumentManager
doc = DocumentManager.Instance.CurrentDBDocument
uiapp = DocumentManager.Instance.CurrentUIApplication
uidoc = DocumentManager.Instance.CurrentUIApplication.ActiveUIDocument
app = uiapp.Application


ids = uidoc.Selection.GetElementIds()
elems = []
for id in ids:
	try:
		elems.append(doc.GetElement(id))
	except:
		elems.append('Element retrieval failed')

OUT = elems
# ----------------------------------------
getCategory = Element.GetCategory(element=select_model_elements)
input_check = Python(IN[0]=getCategory)  # IronPython2
# ---------- input_check.python (8 lines) ----------
input = IN[0]
elements = []

if isinstance(input, list): 
	for i in input:	elements.append(i)
else: elements = [input]
		
OUT = elements
# ----------------------------------------
code_block = CodeBlock { "Sheets"; }
byName = Category.ByName(name=code_block)
input_check_2 = Python(IN[0]=select_model_elements)  # IronPython2; same code as input_check
category_filter = Python(IN[0]=input_check, IN[1]=byName, IN[2]=input_check_2, IN[3]=select_model_elements)  # IronPython2
# ---------- category_filter.python (8 lines) ----------
outt = []

for i in range(len(IN[0])):
	if IN[0][i] ==IN[1]:
		outt.append(IN[2][i])
		
if IN[3] == []: OUT = None
else: OUT = outt
# ----------------------------------------
sorted = Python(IN[0]=category_filter)  # IronPython2
# ---------- sorted.python (17 lines) ----------
import clr
clr.AddReference('ProtoGeometry')
from Autodesk.DesignScript.Geometry import *
#The inputs to this node will be stored as a list in the IN variable.
if IN[0] != None:
	inp = IN[0]
	zz = []
	for i in inp: zz.append(i.SheetNumber)
	
	zipped = zip(zz,inp)
	
	sorted_zipped_lists = sorted(zipped)
	
	#crazy way to get the second element fom any sublist
	sorted_list1 = [element for _, element in sorted_zipped_lists]
	
	OUT = sorted_list1
# ----------------------------------------
watch = Watch(sorted)  # graph output
watch_2 = Watch(select_model_elements)  # graph output

current = Document.Current()
activeView = Document.ActiveView(document=current)
string_from_object = FromObject(object=activeView)
code_block_2 = CodeBlock { "Sheet(Name = "; }
contains = String.Contains(str=string_from_object, searchFor=code_block_2)
watch_3 = Watch(activeView)
sheetNumber = Sheet.SheetNumber(sheet=watch_3)

# group: check if a user in a view not in a Sheet --> get the Sheet
code_block_3 = CodeBlock { "Sheets"; }
byName_2 = Category.ByName(name=code_block_3)
all_elements_of_category = ElementsOfCategory(Category=byName_2)

sheetNumber_2 = Sheet.SheetNumber(sheet=all_elements_of_category)

# group (continued): check if a user in a view not in a Sheet --> get the Sheet
contains_2 = String.Contains(str=sheetNumber_2, searchFor=sheetNumber, lacing=Longest)
flatten = List.Flatten(list=contains_2)
filterByBoolMask = List.FilterByBoolMask(list=all_elements_of_category, mask=flatten)

if_ = If(test=contains, true=activeView, false=filterByBoolMask.in)
python_script = Python(IN[0]=sorted, IN[1]=if_)  # IronPython2
# ---------- python_script.python (4 lines) ----------
if IN[0] == None:
	OUT = IN[1]
else: OUT = IN[0]
	
# ----------------------------------------
input_check_3 = Python(IN[0]=python_script)  # IronPython2; same code as input_check

# group: print and open the file and the folder
current_2 = Document.Current()
filePath = Document.FilePath(document=current_2)
export_folder = Python(IN[0]=filePath)  # IronPython2
# ---------- export_folder.python (17 lines) ----------
import os

x = IN[0].split('\\')

line = []
y = x[:-1]
z = []
for i in y: 
	z.append(i+'\\')
line = (''.join(z))

newpath = line+'Export'

if not os.path.exists(newpath):
    os.makedirs(newpath)
    
OUT = newpath
# ----------------------------------------
watch_4 = Watch(export_folder)
folder = Python(IN[0]=filePath)  # IronPython2
# ---------- folder.python (7 lines) ----------
x = IN[0].split('\\')

f = x[len(x)-1:]

m = f[0].split(".")

OUT = m[0]
# ----------------------------------------
current_date = Python(IN[0]=folder)  # IronPython2
# ---------- current_date.python (3 lines) ----------
from datetime import date
today = date.today()
OUT = IN[0] + ' ' +today.strftime("%d.%m.%y")
# ----------------------------------------
file_name_generator = Python(IN[0]=watch_4, IN[1]=current_date)  # IronPython2
# ---------- file_name_generator.python (49 lines) ----------
import os

name = IN[0] + '\\' + IN[1] + ".pdf"

if os.path.exists(name) == False: 
	OUT = name
else:
	name = IN[0] + '\\' + IN[1] + " v2.pdf"
	if os.path.exists(name) == False: 
		OUT = name 
	else:
		name = IN[0] + '\\' + IN[1] + " v3.pdf"
		if os.path.exists(name) == False: 
			OUT = name
		else:
			name = IN[0] + '\\' + IN[1] + " v4.pdf"		
			if os.path.exists(name) == False: 
				OUT = name
			else:
				name = IN[0] + '\\' + IN[1] + " v5.pdf"
				if os.path.exists(name) == False: 
					OUT = name
				else:
					name = IN[0] + '\\' + IN[1] + " v6.pdf"
					if os.path.exists(name) == False: 
						OUT = name
					else:
						name = IN[0] + '\\' + IN[1] + " v7.pdf"		
						if os.path.exists(name) == False: 
							OUT = name
						else:
							name = IN[0] + '\\' + IN[1] + " v8.pdf"	
							if os.path.exists(name) == False: 
								OUT = name
							else:
								name = IN[0] + '\\' + IN[1] + " v9.pdf"		
								if os.path.exists(name) == False: 
									OUT = name
								else:
									name = IN[0] + '\\' + IN[1] + " v10.pdf"	
									if os.path.exists(name) == False: 
										OUT = name
									else:
										name = IN[0] + '\\' + IN[1] + " v11.pdf"	
										if os.path.exists(name) == False: 
											OUT = name
										else:
											name = IN[0] + '\\' + IN[1] + " v12.pdf"	
											OUT = name											
# ----------------------------------------
name_only = Python(IN[0]=file_name_generator)  # IronPython2
# ---------- name_only.python (8 lines) ----------
x = IN[0].split('\\')

f = x[len(x)-1:]

g = f[0].replace(".pdf","")


OUT = g
# ----------------------------------------
pdf_print = Python(IN[0]=input_check_3, IN[1]=name_only, IN[2]=watch_4)  # IronPython2
# ---------- pdf_print.python (38 lines) ----------
#Sean Page, 2021
import clr

clr.AddReference('RevitAPI')
from Autodesk.Revit.DB import *

clr.AddReference('System')
from System.Collections.Generic import List

clr.AddReference('RevitNodes')
import Revit
clr.ImportExtensions(Revit.Elements)

clr.AddReference('RevitServices')
import RevitServices
from RevitServices.Persistence import DocumentManager

doc = DocumentManager.Instance.CurrentDBDocument

Sheets = UnwrapElement(IN[0])
Names = IN[1]
Folder = IN[2]
result = []

opts = PDFExportOptions()
opts.Combine = True
opts.ColorDepth = ColorDepthType.Color
opts.ExportQuality = PDFExportQualityType.DPI600
opts.PaperFormat = ExportPaperFormat.Default #This will uses the Sheet Size for Paper size
opts.FileName = Names

sheetSet = List[ElementId]()
for i in Sheets:       
	sheetSet.Add(i.Id)

result.append(doc.Export(Folder,sheetSet,opts))

OUT = sheetSet
# ----------------------------------------
flow_check = Python(IN[0]=pdf_print)  # IronPython2
# ---------- flow_check.python (1 lines) ----------
if IN[0]: OUT = True
# ----------------------------------------
string = StringInput("C:\Program Files (x86)\Adobe\Acrobat DC\Acrobat\Acrobat.exe")
string_2 = StringInput("C:\Program Files\Bluebeam Software\Bluebeam Revu\Revu\Revu.exe")
file_open = Python(IN[0]=file_name_generator, IN[1]=flow_check, IN[2]=string, IN[3]=string_2)  # IronPython2
# ---------- file_open.python (38 lines) ----------
# Load the Python Standard and DesignScript Libraries
import sys
import clr
import os
import subprocess

#clr.AddReference('ProtoGeometry')
#from Autodesk.DesignScript.Geometry import *

# The inputs to this node will be stored as a list in the IN variables.
#dataEnteringNode = IN

# Place your code below this line


txt1 = IN[0]

#txt1 = 'C:\1.txt'
bool = IN[1]


#SPath = r'C:\Windows\System32\notepad.exe'


try:
	if bool:
		subprocess.Popen([IN[2], txt1])
		OUT = 'success'

		
except:
	if bool:
		subprocess.Popen([IN[3], txt1])
		OUT = 'success'


#subprocess.Popen('explorer "C:\temp"') #itWorks!
# Assign your output to the OUT variable.
# ----------------------------------------
folder_open = Python(IN[0]=watch_4, IN[1]=file_open)  # IronPython2
# ---------- folder_open.python (13 lines) ----------
if IN[1] == 'success':
	import sys
	import clr
	import os
	import subprocess
	
	txt2 = str('explorer '+'"'+str(IN[0])+'"')	
	
	if bool:
		#subprocess.Popen(txt2)
		os.startfile(IN[0]) #this one do not open explorer again and again
			
OUT = 0
# ----------------------------------------
