# Dynamo graph Print_Current_Toshiba.dyn (Dynamo 2.10.1.3976)

# group: get the selected sheets if any
select_model_elements = Python()  # IronPython2; unwired: IN[0]
# ---------- select_model_elements.python (27 lines) ----------
import clr
clr.AddReference('RevitNodes')
import Revit
clr.ImportExtensions(Revit.GeometryConversion)

clr.AddReference('RevitAPI')
import Autodesk
from Autodesk.Revit.DB import *

clr.AddReference("RevitServices")
import RevitServices
from RevitServices.Persistence import DocumentManager
doc = DocumentManager.Instance.CurrentDBDocument
uiapp = DocumentManager.Instance.CurrentUIApplication
uidoc = DocumentManager.Instance.CurrentUIApplication.ActiveUIDocument
app = uiapp.Application


ids = uidoc.Selection.GetElementIds()
elems = []
for id in ids:
	try:
		elems.append(doc.GetElement(id))
	except:
		elems.append('Element retrieval failed')

OUT = elems
# ----------------------------------------
getCategory = Element.GetCategory(element=select_model_elements)
input_check = Python(IN[0]=getCategory)  # IronPython2
# ---------- input_check.python (8 lines) ----------
input = IN[0]
elements = []

if isinstance(input, list): 
	for i in input:	elements.append(i)
else: elements = [input]
		
OUT = elements
# ----------------------------------------
code_block = CodeBlock { "Sheets"; }
byName = Category.ByName(name=code_block)
input_check_2 = Python(IN[0]=select_model_elements)  # IronPython2; same code as input_check
category_filter = Python(IN[0]=input_check, IN[1]=byName, IN[2]=input_check_2, IN[3]=select_model_elements)  # IronPython2
# ---------- category_filter.python (8 lines) ----------
outt = []

for i in range(len(IN[0])):
	if IN[0][i] ==IN[1]:
		outt.append(IN[2][i])
		
if IN[3] == []: OUT = None
else: OUT = outt
# ----------------------------------------
sorted = Python(IN[0]=category_filter)  # IronPython2
# ---------- sorted.python (17 lines) ----------
import clr
clr.AddReference('ProtoGeometry')
from Autodesk.DesignScript.Geometry import *
#The inputs to this node will be stored as a list in the IN variable.
if IN[0] != None:
	inp = IN[0]
	zz = []
	for i in inp: zz.append(i.SheetNumber)
	
	zipped = zip(zz,inp)
	
	sorted_zipped_lists = sorted(zipped)
	
	#crazy way to get the second element fom any sublist
	sorted_list1 = [element for _, element in sorted_zipped_lists]
	
	OUT = sorted_list1
# ----------------------------------------
watch = Watch(sorted)  # graph output
watch_2 = Watch(select_model_elements)  # graph output

current = Document.Current()
activeView = Document.ActiveView(document=current)
string_from_object = FromObject(obj=activeView)
code_block_2 = CodeBlock { "Sheet(Name = "; }
contains = String.Contains(str=string_from_object, searchFor=code_block_2)
watch_3 = Watch(activeView)
sheetNumber = Sheet.SheetNumber(sheet=watch_3)

# group: check if a user in a view not in a Sheet --> get the Sheet
code_block_3 = CodeBlock { "Sheets"; }
byName_2 = Category.ByName(name=code_block_3)
all_elements_of_category = ElementsOfCategory(Category=byName_2)

sheetNumber_2 = Sheet.SheetNumber(sheet=all_elements_of_category)

# group (continued): check if a user in a view not in a Sheet --> get the Sheet
contains_2 = String.Contains(str=sheetNumber_2, searchFor=sheetNumber, lacing=Longest)
flatten = List.Flatten(list=contains_2)
filterByBoolMask = List.FilterByBoolMask(list=all_elements_of_category, mask=flatten)

if_ = If(test=contains, true=activeView, false=filterByBoolMask.in)
python_script = Python(IN[0]=sorted, IN[1]=if_)  # IronPython2
# ---------- python_script.python (4 lines) ----------
if IN[0] == None:
	OUT = IN[1]
else: OUT = IN[0]
	
# ----------------------------------------
input_check_3 = Python(IN[0]=python_script)  # IronPython2; same code as input_check
code_block_4 = CodeBlock { "Select"; }
printer = StringInput("TOSHIBA")
get_all_print_settings = Python()  # IronPython2; unwired: IN[0]
# ---------- get_all_print_settings.python (29 lines) ----------
import clr

clr.AddReference('RevitAPI')
from Autodesk.Revit.DB import *
clr.AddReference("RevitNodes")
import Revit
clr.ImportExtensions(Revit.Elements)

clr.AddReference("RevitServices")
import RevitServices
from RevitServices.Persistence import DocumentManager
from RevitServices.Transactions import TransactionManager


doc = DocumentManager.Instance.CurrentDBDocument

yy = FilteredElementCollector(doc).OfClass(PrintSetting).WhereElementIsNotElementType().ToElements()

zz = []
for i in yy: zz.append(i.Name)

t = zip(zz,yy)

flat_list = []
for sublist in t:
    for item in sublist:
        flat_list.append(item)

OUT = flat_list
# ----------------------------------------
string_from_object_2 = FromObject(obj=get_all_print_settings)
python_script_2 = Python(IN[0]=sorted, IN[1]=if_)  # IronPython2; same code as python_script
get_the_titleblock_size = Python(IN[0]=python_script_2)  # IronPython2
# ---------- get_the_titleblock_size.python (25 lines) ----------
import clr
clr.AddReference('RevitNodes')
import Revit
clr.ImportExtensions(Revit.GeometryConversion)

clr.AddReference('RevitAPI')
import Autodesk
from Autodesk.Revit.DB import *

clr.AddReference("RevitServices")
import RevitServices
from RevitServices.Persistence import DocumentManager
doc = DocumentManager.Instance.CurrentDBDocument

toList = lambda x : x if hasattr(x, '__iter__') else [x]
out= []

viewlst = toList(UnwrapElement(IN[0]))
for view in viewlst:
	titleBkl = FilteredElementCollector(doc, view.Id).OfClass(FamilyInstance).OfCategory(BuiltInCategory.OST_TitleBlocks).FirstElement()
	bbx = titleBkl.get_BoundingBox(view)
	width = bbx.Max.ToPoint().X - bbx.Min.ToPoint().X
	height = bbx.Max.ToPoint().Y - bbx.Min.ToPoint().Y
	out.append("{} x {}".format(width, height))
OUT = out
# ----------------------------------------
string = StringInput(" x ")
split = String.Split(str=get_the_titleblock_size, separator0=string)
firstItem = List.FirstItem(list=split, lacing=Longest)
input_check_4 = Python(IN[0]=firstItem)  # IronPython2; same code as input_check
get_name_from_size = Python(IN[0]=input_check_4)  # IronPython2
# ---------- get_name_from_size.python (11 lines) ----------
outp = []

for i in IN[0]:

	inp = int(float(i))
	if inp == 841: outp.append('A1')
	elif inp==594: outp.append('A2')
	elif inp==297: outp.append('A4')		
	else: outp.append('A3')#default scenrio
		
OUT = outp
# ----------------------------------------
formats_to_printer_comparison = Python(IN[0]=string_from_object_2, IN[1]=get_name_from_size, IN[2]=get_all_print_settings)  # IronPython2
# ---------- formats_to_printer_comparison.python (28 lines) ----------
search = IN[0]
inp = IN[1]
obj = IN[2]
z = []

#PRINTER SETTINGS YOU WANT TO USE
A1 = "A1_to_A3"
A2 = "A2_to_A3"
A3 = "pdfFactory Pro_Default A3"
A4 = "pdfFactory Pro_Default A4"


for i in range(len(inp)):
	if "A1" in inp[i] and A1 in search:
		pos = search.index(A1)	
		z.append(obj[pos+1])
	elif "A2" in inp[i] and A2 in search:
			pos = search.index(A2)
			z.append(obj[pos+1])
	elif "A3" in inp[i] and A3 in search:
			pos = search.index(A3)
			z.append(obj[pos+1])
	elif "A4" in inp[i] and A4 in search:
			pos = search.index(A4)
			z.append(obj[pos+1])	
	else: OUT = "no match"

OUT = z
# ----------------------------------------
run_it = BoolSelector(true)
print_pdf_by_https_archi_lab_net = Python(IN[0]=input_check_3, IN[1]=code_block_4, IN[3]=printer, IN[4]=formats_to_printer_comparison, IN[6]=run_it)  # "print PDF by https://archi-lab.net/printing-pdfs-w-dynamo/"; IronPython2; unwired: IN[2], IN[5]
# ---------- print_pdf_by_https_archi_lab_net.python (125 lines) ----------
#Copyright(c) 2015, Konrad K Sobon
# @arch_laboratory, http://archi-lab.net

import clr
clr.AddReference('ProtoGeometry')
from Autodesk.DesignScript.Geometry import *

# Import Element wrapper extension methods
clr.AddReference("RevitNodes")
import Revit
clr.ImportExtensions(Revit.Elements)

# Import geometry conversion extension methods
clr.ImportExtensions(Revit.GeometryConversion)

# Import DocumentManager and TransactionManager
clr.AddReference("RevitServices")
import RevitServices
from RevitServices.Persistence import DocumentManager
from RevitServices.Transactions import TransactionManager

doc = DocumentManager.Instance.CurrentDBDocument
uiapp = DocumentManager.Instance.CurrentUIApplication
app = uiapp.Application

# Import RevitAPI
clr.AddReference("RevitAPI")
import Autodesk
from Autodesk.Revit.DB import *

import sys
pyt_path = r'C:\Program Files (x86)\IronPython 2.7\Lib'
sys.path.append(pyt_path)
import System

#The inputs to this node will be stored as a list in the IN variable.
dataEnteringNode = IN

sheets = IN[0]
pRange = System.Enum.Parse(Autodesk.Revit.DB.PrintRange, IN[1])
#combined = IN[2]
printerName = IN[3]
printsetting = IN[4]
filePath = IN[5]
runIt = IN[6]

if isinstance(sheets, list):
	viewSheets = []
	for i in sheets:
		viewSheets.append(UnwrapElement(i))
else:
	viewSheets = UnwrapElement(sheets)
	
if isinstance(printsetting, list):
	printSetting = []
	for i in printsetting:
		printSetting.append(UnwrapElement(i))
else:
	printSetting = UnwrapElement(printsetting)

def PrintView(doc, sheet, pRange, printerName, printSetting):
	TransactionManager.Instance.EnsureInTransaction(doc)
	# create view set 
	viewSet = ViewSet()
	viewSet.Insert(sheet)
	# determine print range
	printManager = doc.PrintManager
	printManager.PrintRange = pRange
	printManager.Apply()
	# make new view set current
	viewSheetSetting = printManager.ViewSheetSetting
	viewSheetSetting.CurrentViewSheetSet.Views = viewSet
	# set printer
	printManager.SelectNewPrintDriver(printerName)
	printManager.Apply()
	# set combined and print to file

	
	printSetup = printManager.PrintSetup
	printSetup.CurrentPrintSetting = printSetting
	printManager.Apply()

	# save settings and submit print

	viewSheetSetting.SaveAs("tempSetName")
	printManager.Apply()
	printManager.SubmitPrint()
	viewSheetSetting.Delete()
	TransactionManager.Instance.TransactionTaskDone()
	
	return True

try:
	viewSets = FilteredElementCollector(doc).OfClass(ViewSheetSet)
	for i in viewSets:
		if i.Name == "tempSetName":
			TransactionManager.Instance.EnsureInTransaction(doc)
			doc.Delete(i.Id)
			TransactionManager.Instance.ForceCloseTransaction()
		else:
			continue
		
	errorReport = None
	message = "Success"
	if runIt:
		if isinstance(viewSheets, list) and isinstance(printSetting, list):
			for i, j in zip(viewSheets, printSetting):
				PrintView(doc, i, pRange, printerName,  j)
		elif isinstance(viewSheets, list) and not isinstance(printSetting, list):
			for i in viewSheets:
				PrintView(doc, i, pRange, printerName, printSetting)
		elif not isinstance(viewSheets, list) and not isinstance(printSetting, list):
			PrintView(doc, viewSheets, pRange, printerName, printSetting)
	else:
		message = "Set RunIt to True"
except:
	# if error accurs anywhere in the process catch it
	import traceback
	errorReport = traceback.format_exc()
	
#Assign your output to the OUT variable
if errorReport == None:
	OUT = message
else:
	OUT = errorReport
# ----------------------------------------
code_block_5 = CodeBlock { "0_views"; "1 print range"; "3 printer name"; "4 print settings"; "6 runit"; }
code_block_6 = CodeBlock { "this is for automatic sheet sizing"; }
watch_4 = Watch(get_name_from_size)  # graph output
check = Python(IN[0]=formats_to_printer_comparison)  # IronPython2
# ---------- check.python (38 lines) ----------
#Alban de Chasteigner 2020
#twitter : @geniusloci_bim
#geniusloci.bim@gmail.com
 
import clr
# Import RevitAPI Classes
clr.AddReference('RevitAPI')
import Autodesk
from Autodesk.Revit.DB import FilteredElementCollector, PrintSetting, PrintParameters

# Import DocumentManager and TransactionManager
clr.AddReference("RevitServices")
import RevitServices
from RevitServices.Persistence import DocumentManager

doc = DocumentManager.Instance.CurrentDBDocument
elements = UnwrapElement(IN[0]) if isinstance(IN[0],list) else [UnwrapElement(IN[0])]
sizes,orientations,names,sources,placements,zooms,hidden,colors=[],[],[],[],[],[],[],[]

if IN[0] == None:
	prinsettings = FilteredElementCollector(doc).OfClass(PrintSetting).WhereElementIsNotElementType().ToElements()
else:prinsettings = elements

for col in prinsettings:
	names.append(col.Name)
	try :
		sizes.append(col.PrintParameters.PaperSize.Name)
	except:
		sizes.append(None)
	orientations.append(col.PrintParameters.PageOrientation)
	sources.append(col.PrintParameters.PaperSource.Name)
	placements.append(col.PrintParameters.PaperPlacement)
	zooms.append(col.PrintParameters.ZoomType)
	hidden.append(col.PrintParameters.HiddenLineViews)
	colors.append(col.PrintParameters.ColorDepth)

if isinstance(IN[0], list) or IN[0] == None : OUT = names,sizes
else: OUT = names[0],sizes[0]
# ----------------------------------------
