# Dynamo graph Print_Last_Rev.dyn (Dynamo 2.6.1.8786)

code_block = CodeBlock { "0_views"; "1 print range"; "3 printer name"; "4 print settings"; "6 runit"; }
code_block_2 = CodeBlock { "this is for automatic sheet sizing"; }
setParameterByName = Element.SetParameterByName()  # unwired: element, parameterName, value
get_all_sheets = Python()  # unwired: IN[0]
# ---------- get_all_sheets.python (25 lines) ----------
import clr

clr.AddReference('RevitAPI')
from Autodesk.Revit.DB import *
clr.AddReference("RevitNodes")
import Revit
clr.ImportExtensions(Revit.Elements)

clr.AddReference("RevitServices")
import RevitServices
from RevitServices.Persistence import DocumentManager
from RevitServices.Transactions import TransactionManager


doc = DocumentManager.Instance.CurrentDBDocument

#getting all the views required
#lv = FilteredElementCollector(doc).OfClass(ViewPlan).WhereElementIsNotElementType().ToElements()

#xx = FilteredElementCollector(doc).OfClass(ViewSection).WhereElementIsNotElementType().ToElements()

yy = FilteredElementCollector(doc).OfClass(ViewSheet).WhereElementIsNotElementType().ToElements()


OUT = yy
# ----------------------------------------
get_revisions_on_sheet = Python(IN[0]=get_all_sheets)
# ---------- get_revisions_on_sheet.python (28 lines) ----------
import clr

clr.AddReference('RevitAPI')
from Autodesk.Revit.DB import *
clr.AddReference("RevitNodes")
import Revit
clr.ImportExtensions(Revit.Elements)

clr.AddReference("RevitServices")
import RevitServices
from RevitServices.Persistence import DocumentManager
from RevitServices.Transactions import TransactionManager


doc = DocumentManager.Instance.CurrentDBDocument

yy = UnwrapElement(IN[0])
#yy = FilteredElementCollector(doc).OfClass(ViewSheet).WhereElementIsNotElementType().ToElements()

ff = []

for i in yy:
	ff.append(i.GetAllRevisionIds())
	
#elementid = []
#for i in ff: elementid.append(ElementId(i.Id))

OUT = ff
# ----------------------------------------
element_by_id = ElementById(Id=get_revisions_on_sheet)
revisionDate = Revision.RevisionDate(revision=element_by_id)
to_string_easily = Python(IN[0]=revisionDate)
# ---------- to_string_easily.python (11 lines) ----------
#Copyright(c) 2015, Konrad K Sobon
# @arch_laboratory, http://archi-lab.net

import clr
clr.AddReference('ProtoGeometry')
from Autodesk.DesignScript.Geometry import *
#The inputs to this node will be stored as a list in the IN variable.
inp = IN[0]


OUT = map(str,inp)
# ----------------------------------------
flatten = List.Flatten(list=revisionDate)
sorted_by_date = Python(IN[0]=flatten)
# ---------- sorted_by_date.python (12 lines) ----------
k = list(set(IN[0]))
y = []
for i in k:
	x = i[6:8]+i[3:5]+i[0:2]
	y.append(x)


c = zip(y, k)

f = sorted(c)
#strange way to get second element from every sublist
OUT = [element for _, element in f]
# ----------------------------------------
lastItem = List.LastItem(list=sorted_by_date)
contains = String.Contains(str=to_string_easily, searchFor=lastItem)
filterByBoolMask = List.FilterByBoolMask(list=get_all_sheets, mask=contains)
code_block_3 = CodeBlock { "Appears In Sheet List"; }
parameterByName = Parameter.ParameterByName(element=get_all_sheets, name=code_block_3)
string_from_object = FromObject(obj=parameterByName)
if_no_rev_print_all = Python(IN[0]=get_all_sheets, IN[1]=filterByBoolMask.in, IN[2]=string_from_object)
# ---------- if_no_rev_print_all.python (21 lines) ----------
aa = UnwrapElement(IN[0])
bb = UnwrapElement(IN[1])
cc = UnwrapElement(IN[2])

if bb == None:
	xx = []
	for i in range(len(aa)):
		if cc[i] == "Appears In Sheet List : Yes":
			xx.append(aa[i])
	#This script pops up a dialog box with a message from the previous node.
	
	import clr
	clr.AddReference('RevitAPIUI')
	from Autodesk.Revit.UI import TaskDialog
	messagePop = TaskDialog("Dynamo Player")
	messagePop.MainContent = "No revision found, print all sheets"
	messagePop.Show()
	
	OUT = xx
	
else: OUT = IN[1]
# ----------------------------------------
sorted = Python(IN[0]=if_no_rev_print_all)
# ---------- sorted.python (16 lines) ----------
import clr
clr.AddReference('ProtoGeometry')
from Autodesk.DesignScript.Geometry import *
#The inputs to this node will be stored as a list in the IN variable.
inp = IN[0]
zz = []
for i in inp: zz.append(i.SheetNumber)

zipped = zip(zz,inp)

sorted_zipped_lists = sorted(zipped)

#crazy way to get the second element fom any sublist
sorted_list1 = [element for _, element in sorted_zipped_lists]

OUT = sorted_list1
# ----------------------------------------
get_the_titleblock_size = Python(IN[0]=sorted)
# ---------- get_the_titleblock_size.python (28 lines) ----------
import clr
clr.AddReference('RevitNodes')
import Revit
clr.ImportExtensions(Revit.GeometryConversion)

clr.AddReference('RevitAPI')
import Autodesk
from Autodesk.Revit.DB import *

clr.AddReference("RevitServices")
import RevitServices
from RevitServices.Persistence import DocumentManager
doc = DocumentManager.Instance.CurrentDBDocument

toList = lambda x : x if hasattr(x, '__iter__') else [x]
out= []

viewlst = toList(UnwrapElement(IN[0]))
for view in viewlst:
	try: 
		titleBkl = FilteredElementCollector(doc, view.Id).OfClass(FamilyInstance).OfCategory(BuiltInCategory.OST_TitleBlocks).FirstElement()
		bbx = titleBkl.get_BoundingBox(view)
		width = bbx.Max.ToPoint().X - bbx.Min.ToPoint().X
		height = bbx.Max.ToPoint().Y - bbx.Min.ToPoint().Y
		out.append("{} x {}".format(width, height))
	except: #get previous working one
		out.append(out[len(out)-1])	
OUT = out
# ----------------------------------------
string = StringInput(" x ")
split = String.Split(str=get_the_titleblock_size, separator0=string)
firstItem = List.FirstItem(list=split, lacing=Longest)
input_check = Python(IN[0]=firstItem)
# ---------- input_check.python (8 lines) ----------
input = IN[0]
elements = []

if isinstance(input, list): 
	for i in input:	elements.append(i)
else: elements = [input]
		
OUT = elements
# ----------------------------------------
get_name_from_size = Python(IN[0]=input_check)
# ---------- get_name_from_size.python (11 lines) ----------
outp = []

for i in IN[0]:

	inp = int(float(i))
	if inp == 841: outp.append('A1')
	elif inp==594: outp.append('A2')
	elif inp==297: outp.append('A4')		
	else: outp.append('A3')#default scenrio
		
OUT = outp
# ----------------------------------------
watch = Watch(get_name_from_size)  # graph output
watch_2 = Watch(sorted)
code_block_4 = CodeBlock { "Select"; }
printer = StringInput("pdfFactory Pro")
get_all_print_settings = Python()  # unwired: IN[0]
# ---------- get_all_print_settings.python (29 lines) ----------
import clr

clr.AddReference('RevitAPI')
from Autodesk.Revit.DB import *
clr.AddReference("RevitNodes")
import Revit
clr.ImportExtensions(Revit.Elements)

clr.AddReference("RevitServices")
import RevitServices
from RevitServices.Persistence import DocumentManager
from RevitServices.Transactions import TransactionManager


doc = DocumentManager.Instance.CurrentDBDocument

yy = FilteredElementCollector(doc).OfClass(PrintSetting).WhereElementIsNotElementType().ToElements()

zz = []
for i in yy: zz.append(i.Name)

t = zip(zz,yy)

flat_list = []
for sublist in t:
    for item in sublist:
        flat_list.append(item)

OUT = flat_list
# ----------------------------------------
string_from_object_2 = FromObject(obj=get_all_print_settings)
find_from_name = Python(IN[0]=string_from_object_2, IN[1]=get_name_from_size, IN[2]=get_all_print_settings)
# ---------- find_from_name.python (11 lines) ----------
inp = IN[1]
search = IN[0]
obj = IN[2]
z = []

for i in inp:
	for j in range(len(search)):
		if i in search[j]: z.append(obj[j+1])


OUT = z
# ----------------------------------------
run_it = BoolSelector(true)
print_pdf_by_https_archi_lab_net = Python(IN[0]=watch_2, IN[1]=code_block_4, IN[3]=printer, IN[4]=find_from_name, IN[6]=run_it)  # "print PDF by https://archi-lab.net/printing-pdfs-w-dynamo/"; unwired: IN[2], IN[5]
# ---------- print_pdf_by_https_archi_lab_net.python (125 lines) ----------
#Copyright(c) 2015, Konrad K Sobon
# @arch_laboratory, http://archi-lab.net

import clr
clr.AddReference('ProtoGeometry')
from Autodesk.DesignScript.Geometry import *

# Import Element wrapper extension methods
clr.AddReference("RevitNodes")
import Revit
clr.ImportExtensions(Revit.Elements)

# Import geometry conversion extension methods
clr.ImportExtensions(Revit.GeometryConversion)

# Import DocumentManager and TransactionManager
clr.AddReference("RevitServices")
import RevitServices
from RevitServices.Persistence import DocumentManager
from RevitServices.Transactions import TransactionManager

doc = DocumentManager.Instance.CurrentDBDocument
uiapp = DocumentManager.Instance.CurrentUIApplication
app = uiapp.Application

# Import RevitAPI
clr.AddReference("RevitAPI")
import Autodesk
from Autodesk.Revit.DB import *

import sys
pyt_path = r'C:\Program Files (x86)\IronPython 2.7\Lib'
sys.path.append(pyt_path)
import System

#The inputs to this node will be stored as a list in the IN variable.
dataEnteringNode = IN

sheets = IN[0]
pRange = System.Enum.Parse(Autodesk.Revit.DB.PrintRange, IN[1])
#combined = IN[2]
printerName = IN[3]
printsetting = IN[4]
filePath = IN[5]
runIt = IN[6]

if isinstance(sheets, list):
	viewSheets = []
	for i in sheets:
		viewSheets.append(UnwrapElement(i))
else:
	viewSheets = UnwrapElement(sheets)
	
if isinstance(printsetting, list):
	printSetting = []
	for i in printsetting:
		printSetting.append(UnwrapElement(i))
else:
	printSetting = UnwrapElement(printsetting)

def PrintView(doc, sheet, pRange, printerName, printSetting):
	TransactionManager.Instance.EnsureInTransaction(doc)
	# create view set 
	viewSet = ViewSet()
	viewSet.Insert(sheet)
	# determine print range
	printManager = doc.PrintManager
	printManager.PrintRange = pRange
	printManager.Apply()
	# make new view set current
	viewSheetSetting = printManager.ViewSheetSetting
	viewSheetSetting.CurrentViewSheetSet.Views = viewSet
	# set printer
	printManager.SelectNewPrintDriver(printerName)
	printManager.Apply()
	# set combined and print to file

	
	printSetup = printManager.PrintSetup
	printSetup.CurrentPrintSetting = printSetting
	printManager.Apply()

	# save settings and submit print

	viewSheetSetting.SaveAs("tempSetName")
	printManager.Apply()
	printManager.SubmitPrint()
	viewSheetSetting.Delete()
	TransactionManager.Instance.TransactionTaskDone()
	
	return True

try:
	viewSets = FilteredElementCollector(doc).OfClass(ViewSheetSet)
	for i in viewSets:
		if i.Name == "tempSetName":
			TransactionManager.Instance.EnsureInTransaction(doc)
			doc.Delete(i.Id)
			TransactionManager.Instance.ForceCloseTransaction()
		else:
			continue
		
	errorReport = None
	message = "Success"
	if runIt:
		if isinstance(viewSheets, list) and isinstance(printSetting, list):
			for i, j in zip(viewSheets, printSetting):
				PrintView(doc, i, pRange, printerName,  j)
		elif isinstance(viewSheets, list) and not isinstance(printSetting, list):
			for i in viewSheets:
				PrintView(doc, i, pRange, printerName, printSetting)
		elif not isinstance(viewSheets, list) and not isinstance(printSetting, list):
			PrintView(doc, viewSheets, pRange, printerName, printSetting)
	else:
		message = "Set RunIt to True"
except:
	# if error accurs anywhere in the process catch it
	import traceback
	errorReport = traceback.format_exc()
	
#Assign your output to the OUT variable
if errorReport == None:
	OUT = message
else:
	OUT = errorReport
# ----------------------------------------
