# Dynamo graph Robot.Claddings.Final.may.dyn (Dynamo 2.6.0.8481)

cladding_type = StringInput("One-way X")
cladding_type_2 = StringInput("One-way Y")
robot_library_address = StringInput("C:\Users\64210\AppData\Roaming\Dynamo\Dynamo Core\2.6\packages\Structural Analysis for Dynamo\bin\RSA\Interop.RobotOM.dll")
slide_it_before_run_to_restart = DoubleSlider(28.2, range=0..100 step 0.1)  # "slide it before Run to restart the goddam script"
get_selected_nodes = Python(IN[0]=robot_library_address, IN[1]=slide_it_before_run_to_restart)
# ---------- get_selected_nodes.python (30 lines) ----------
import clr
clr.AddReference('ProtoGeometry')
from Autodesk.DesignScript.Geometry import *
from System import Environment
user = Environment.GetFolderPath(Environment.SpecialFolder.ApplicationData)
clr.AddReferenceToFileAndPath(IN[0])#or r"C:\Users\64210\AppData\Roaming\Dynamo\Dynamo Core\2.6\packages\Structural Analysis for Dynamo\bin\RSA\Interop.RobotOM.dll"
from RobotOM import *
from System import Object

random = IN[1]

app = RobotApplicationClass()
project = app.Project
structure = project.Structure
labels = structure.Labels
loads = structure.Cases
ProjectPrefs = project.Preferences
bars = structure.Bars
objects = structure.Objects
nodes = structure.Nodes


sel = structure.Selections.Get(IRobotObjectType.I_OT_NODE)
sel2 = nodes.GetMany(sel)

f = []
for i in range(1,sel2.Count+1,1): f.append(sel.Get(i))


OUT = f
# ----------------------------------------
cladding_type_3 = StringInput("Two-way")
create_cladding_aroud_given = Python(IN[0]=get_selected_nodes, IN[1]=robot_library_address, IN[2]=cladding_type_3)  # "Create cladding aroud given point"
# ---------- create_cladding_aroud_given.python (438 lines) ----------
import clr
clr.AddReference('ProtoGeometry')
from Autodesk.DesignScript.Geometry import *
from System import Environment
user = Environment.GetFolderPath(Environment.SpecialFolder.ApplicationData)
clr.AddReferenceToFileAndPath(IN[1])#or r"C:\Users\64210\AppData\Roaming\Dynamo\Dynamo Core\2.6\packages\Structural Analysis for Dynamo\bin\RSA\Interop.RobotOM.dll"
from RobotOM import *
from System import Object
from math import *
from itertools import compress

clad_typename = IN[2]

#vars for robot
app = RobotApplicationClass()
project = app.Project
structure = project.Structure
labels = structure.Labels
loads = structure.Cases
ProjectPrefs = project.Preferences
bars = structure.Bars
objects = structure.Objects
nodes = structure.Nodes

xnode = IN[0]



def program_one_point(xnode):
	# 3 POINT PROGRAM
	# The inputs to this node will be stored as a list in the IN variables.
	
	def find_req_nodes(xnode):
		#GET THE NODES
		if type(xnode)!=str:
			coll = bars.GetAll()
			node = xnode	#check for the  looping process safety
			x = nodes.GetConnectedBars(node) #bars connected to point
			f = []
			for i in range(1,x.Count+1,1): f.append(coll.Get(i)) #get bars
			z = []
			for i in range(1,x.Count+1,1): z.append(x.Get(i)) #get bars' numbers
			a = []
			for i in z: a.append(bars.Get(i)) #and get bars back, that how it works
			s = []
			for i in a: s.append(nodes.Get(i.StartNode)) #get nodes
			e = []
			for i in a: e.append(nodes.Get(i.EndNode)) #get nodes	
			#make the list of nodes
			nodelistS = []
			for i in s: nodelistS.append(Point.ByCoordinates(i.x,i.y,i.z))
			nodelistE = []
			for i in e: nodelistE.append(Point.ByCoordinates(i.x,i.y,i.z))
			#make preselected basepoint
			basepoint = Point.ByCoordinates(nodes.Get(node).X, nodes.Get(node).Y, nodes.Get(node).Z)
			#clean unwanted points
			while basepoint in nodelistS: nodelistS.remove(basepoint) 
			while basepoint in nodelistE: nodelistE.remove(basepoint)
			bp = []
			bp.append(basepoint)
			nodelist = bp+nodelistS+nodelistE
		else: nodelist = "all done"
		return nodelist

	nodelist = find_req_nodes(xnode)
	
	
	
	input = nodelist
	
	
	
	def program3():	
		fn = objects.FreeNumber
		p1 = input[0]
		p2 = input[1]
		p3 = input[2]
		
		points = app.CmpntFactory.Create(IRobotComponentType.I_CT_POINTS_ARRAY)
		points.SetSize(3)
		points.Set(1,p1.X,p1.Y,p1.Z)
		points.Set(2,p2.X,p2.Y,p2.Z)
		points.Set(3,p3.X,p3.Y,p3.Z)
		
		objects.CreateContour(fn, points)
		ro = objects.Get(fn)
		
		ro.Initialize()
		ro.SetLabel(IRobotLabelType.I_LT_CLADDING, clad_typename)
		ro.Update()
	
	if len(input) == 3: program3()
	# END
	
	
	
	# 4 POINT PROGRAM
	def program4():
		#get nodes from the list
		p1 = input[0]
		p2 = input[1]
		p3 = input[2]
		p4 = input[3]
		
		#get angle between 3 vectors
		v1 = Vector.ByTwoPoints(p1,p2)
		v2 = Vector.ByTwoPoints(p1,p3)
		v3 = Vector.ByTwoPoints(p1,p4)
		
		v12 = [p1,p2,p3]
		v23 = [p1,p3,p4]
		v13 = [p1,p2,p4]
		v_comb = [v12]+[v23]+[v13]
		
		x1 = v1.X
		y1 = v1.Y
		z1 = v1.Z
		x2 = v2.X
		y2 = v2.Y
		z2 = v2.Z
		x3 = v3.X
		y3 = v3.Y
		z3 = v3.Z
		
		#get first angle
		ab = x1*x2+y1*y2+z1*z2
		aa = sqrt(x1*x1+y1*y1+z1*z1)
		bb = sqrt(x2*x2+y2*y2+z2*z2)
		angle1 = acos(ab/(aa*bb))*57.2958
		#get second angle
		ab = x1*x3+y1*y3+z1*z3
		aa = sqrt(x1*x1+y1*y1+z1*z1)
		bb = sqrt(x3*x3+y3*y3+z3*z3)
		angle3 = acos(ab/(aa*bb))*57.2958
		#get third angle
		ab = x2*x3+y2*y3+z2*z3
		aa = sqrt(x2*x2+y2*y2+z2*z2)
		bb = sqrt(x3*x3+y3*y3+z3*z3)
		angle2 = acos(ab/(aa*bb))*57.2958
		
		angles_list = [angle1]+[angle2]+[angle3]
		 
		#create two list of nodes suitable for cladding
		mm = angles_list.index(max(angles_list))
		new_input = []
		for i in v_comb:
		 new_input.append(i)
		del new_input[mm] 
		
		#get nodes from the new list
		p1 = new_input[0][0]
		p2 = new_input[0][1]
		p3 = new_input[0][2]
		p4 = new_input[1][0]
		p5 = new_input[1][1]
		p6 = new_input[1][2]
		
		#get first free number and create polyline
		fn = objects.FreeNumber
		points = app.CmpntFactory.Create(IRobotComponentType.I_CT_POINTS_ARRAY)
		points.SetSize(3)
		points.Set(1,p1.X,p1.Y,p1.Z)
		points.Set(2,p2.X,p2.Y,p2.Z)
		points.Set(3,p3.X,p3.Y,p3.Z)
		
		objects.CreateContour(fn, points)
		ro = objects.Get(fn)
		
		ro.Initialize()
		ro.SetLabel(IRobotLabelType.I_LT_CLADDING, clad_typename)
		ro.Update()
		#end
		
		#get first free number and create polyline
		fn = objects.FreeNumber
		points = app.CmpntFactory.Create(IRobotComponentType.I_CT_POINTS_ARRAY)
		points.SetSize(3)
		points.Set(1,p4.X,p4.Y,p4.Z)
		points.Set(2,p5.X,p5.Y,p5.Z)
		points.Set(3,p6.X,p6.Y,p6.Z)
		
		objects.CreateContour(fn, points)
		ro = objects.Get(fn)
		
		ro.Initialize()
		ro.SetLabel(IRobotLabelType.I_LT_CLADDING, clad_typename)
		ro.Update()
		#end
		
	if len(input) == 4: program4()
	# END
	
	
	
	# 5 POINT PROGRAM STARTS 
	def program5():
		# nodelist string 52 or close
		
		#get distance
		p1, p_array = nodelist[0], nodelist[1:]
		
		if type(p1) == list:
		    y = p1[0]
		else:
		    y = p1
		
		ldist = []
		for i in p_array:
		   t = sqrt((i.X - p1.X)**2 + (i.Y - p1.Y)**2 + (i.Z - p1.Z)**2); 
		   ldist.append(t)
		   
		#first max value and sorting into lists
		list_d = ldist
		maxs = max(list_d)
		
		y = list_d.index(maxs)
		x = len(list_d)
		z = [10<9]*x
		z[y] = 10>9
		#end
		
		#apply bool mask
		inlist = p_array
		compare = z
		compare_out = [not x for x in z]
		in_first= list(compress(inlist,compare))
		out_first= list(compress(inlist,compare_out))
		
		#find distance between in_ and out_
		
		pp1 = in_first 
		p_array = out_first
		
		if type(pp1) == list:
		    p1 = pp1[0]
		else:
		    p1 = pp1
		
		listdd = []
		
		for i in p_array:
			t = sqrt((i.X - p1.X)**2 + (i.Y - p1.Y)**2 + (i.Z - p1.Z)**2)
			listdd.append(t)
			
		# get angle between 3 points in 3 dir
		
		pt1 = nodelist[0]
		pt2 = in_first
		pt3x = out_first
		
		pt3 = pt3x[0]
		pt4 = pt3x[1]
		pt5 = pt3x[2]
		
		if type(pt1) == list: p1 = pt1[0]
		else: p1 = pt1
		
		if type(pt2) == list: p2 = pt2[0]
		else: p2 = pt2
		
		if type(pt3) == list: p3 = pt3[0]
		else: p3 = pt3
		
		if type(pt4) == list: p4 = pt4[0]
		else: p4 = pt4
		
		if type(pt5) == list: p5 = pt5[0]
		else: p5 = pt5
		# Place your code below this line
		v1 = Vector.ByTwoPoints(p1,p2)
		v2 = Vector.ByTwoPoints(p1,p3)
		v3 = Vector.ByTwoPoints(p1,p4)
		v4 = Vector.ByTwoPoints(p1,p5)
		
		x1 = v1.X
		y1 = v1.Y
		z1 = v1.Z
		x2 = v2.X
		y2 = v2.Y
		z2 = v2.Z
		x3 = v3.X
		y3 = v3.Y
		z3 = v3.Z
		x4 = v4.X
		y4 = v4.Y
		z4 = v4.Z
		
		
		#get first angle
		ab = x1*x2+y1*y2+z1*z2
		aa = sqrt(x1*x1+y1*y1+z1*z1)
		bb = sqrt(x2*x2+y2*y2+z2*z2)
		angle1 = acos(ab/(aa*bb))*57.2958
		#get second angle
		ab = x1*x3+y1*y3+z1*z3
		aa = sqrt(x1*x1+y1*y1+z1*z1)
		bb = sqrt(x3*x3+y3*y3+z3*z3)
		angle2 = acos(ab/(aa*bb))*57.2958
		#get third angle
		ab = x1*x4+y1*y4+z1*z4
		aa = sqrt(x1*x1+y1*y1+z1*z1)
		bb = sqrt(x4*x4+y4*y4+z4*z4)
		angle3 = acos(ab/(aa*bb))*57.2958
		
		angles = [angle1]+[angle2]+[angle3]
		
		# multiple lists and get rid of first max value
		
		list1 = angles
		list2 = listdd
		product = []
		
		for num1, num2 in zip(list1, list2):
		    product.append(num1*num2)
		    
		#get rid of
		list_p = product
		maxx = max(list_p)
		
		y = list_p.index(maxx)
		x = len(list_p)
		z = [10>9]*x
		z[y] = 10<9
		
		#apply bool mask
		inlist = out_first
		compare = z
		compare_out = [not x for x in z]
		in_s= list(compress(inlist,compare))
		out_s= list(compress(inlist,compare_out))
		
		# CREATING CLADDINGS FINAL PART 
		
		p1 = nodelist[0]
		p2 = in_first
		p3 = in_s[0]
		p4 = in_s[1]
		p5 = out_s
		
		#check if input is list
		
		collection = [p1,p2,p3,p4,p5]
		new_coll = []
		for x in collection:
		    if type(x) == list: new_coll.append(x[0])
		    else: new_coll.append(x)
		
		p1 = new_coll[0]
		p2 = new_coll[1]
		p3 = new_coll[2]
		p4 = new_coll[3]
		p5 = new_coll[4]
		
		#create cladding
	
		fn = objects.FreeNumber
		
		points = app.CmpntFactory.Create(IRobotComponentType.I_CT_POINTS_ARRAY)
		points.SetSize(3)
		points.Set(1,p1.X,p1.Y,p1.Z)
		points.Set(2,p2.X,p2.Y,p2.Z)
		points.Set(3,p3.X,p3.Y,p3.Z)
		
		objects.CreateContour(fn, points)
		ro = objects.Get(fn)
		
		ro.Initialize()
		ro.SetLabel(IRobotLabelType.I_LT_CLADDING, clad_typename)
		ro.Update()
		
		fn = objects.FreeNumber
		
		points = app.CmpntFactory.Create(IRobotComponentType.I_CT_POINTS_ARRAY)
		points.SetSize(3)
		points.Set(1,p1.X,p1.Y,p1.Z)
		points.Set(2,p2.X,p2.Y,p2.Z)
		points.Set(3,p4.X,p4.Y,p4.Z)
		
		objects.CreateContour(fn, points)
		ro = objects.Get(fn)
		
		ro.Initialize()
		ro.SetLabel(IRobotLabelType.I_LT_CLADDING, clad_typename)
		ro.Update()
		
		
		fn = objects.FreeNumber
		
		points = app.CmpntFactory.Create(IRobotComponentType.I_CT_POINTS_ARRAY)
		points.SetSize(3)
		points.Set(1,p1.X,p1.Y,p1.Z)
		points.Set(2,p3.X,p3.Y,p3.Z)
		points.Set(3,p5.X,p5.Y,p5.Z)
		
		objects.CreateContour(fn, points)
		ro = objects.Get(fn)
		
		ro.Initialize()
		ro.SetLabel(IRobotLabelType.I_LT_CLADDING, clad_typename)
		ro.Update()
		
		fn = objects.FreeNumber
		
		points = app.CmpntFactory.Create(IRobotComponentType.I_CT_POINTS_ARRAY)
		points.SetSize(3)
		points.Set(1,p1.X,p1.Y,p1.Z)
		points.Set(2,p4.X,p4.Y,p4.Z)
		points.Set(3,p5.X,p5.Y,p5.Z)
		
		objects.CreateContour(fn, points)
		ro = objects.Get(fn)
		
		ro.Initialize()
		ro.SetLabel(IRobotLabelType.I_LT_CLADDING, clad_typename)
		ro.Update()
	
	if len(input) == 5: program5()
	
	
#for i in xnode:
#	program_one_point(xnode) #EXECUTE THE MTHFCKER!

a = []
z = []
    
for i in xnode:
    a = program_one_point(int(i))
    z.append(a)
    
result = z
#
#
#while find_req_nodes():
#	xnode = find_req_nodes()[1]
#	result.append(xnode)

#OUT = 'you are awesome'
OUT = result
# ----------------------------------------
check = Watch(get_selected_nodes)
