# Dynamo graph Sheet_New.dyn (Dynamo 2.10.1.3976)

active_view = Python()  # IronPython2; unwired: IN[0]
# ---------- active_view.python (14 lines) ----------
import clr

clr.AddReference("RevitServices")
import RevitServices
from RevitServices.Persistence import DocumentManager
from RevitServices.Transactions import TransactionManager
doc =  DocumentManager.Instance.CurrentDBDocument
app = DocumentManager.Instance.CurrentUIApplication.Application

clr.AddReference("RevitAPI")
from Autodesk.Revit.DB import *

View = doc.ActiveView
OUT = View
# ----------------------------------------

# group: get the active sheet (works with views too) name to duplicate
code_block = CodeBlock { "Sheet Name"; }
parameterByName = Parameter.ParameterByName(element=active_view, name=code_block)
string_from_object = FromObject(obj=parameterByName)
code_block_2 = CodeBlock { "Sheet Name : "; }
split = String.Split(str=string_from_object, separator0=code_block_2)
firstItem = List.FirstItem(list=split)

code_block_3 = CodeBlock { "Sheets"; }
byName = Category.ByName(name=code_block_3)
all_elements_of_category = ElementsOfCategory(Category=byName)
lastItem = List.LastItem(list=all_elements_of_category)
code_block_4 = CodeBlock { "Sheet Name"; }
parameterByName_2 = Parameter.ParameterByName(element=lastItem, name=code_block_4)
string_from_object_2 = FromObject(obj=parameterByName_2)
code_block_5 = CodeBlock { "Sheet Name : "; }
split_2 = String.Split(str=string_from_object_2, separator0=code_block_5)
lastItem_2 = List.LastItem(list=split_2)
check_for_bloody_sheet = Python(IN[0]=firstItem, IN[1]=lastItem_2)  # IronPython2
# ---------- check_for_bloody_sheet.python (3 lines) ----------
if IN[0] == "null":
	OUT = IN[1] 
else: OUT = IN[0]
# ----------------------------------------
string_from_object_3 = FromObject(obj=check_for_bloody_sheet)
check_for_no_sheets_case = Python(IN[0]=string_from_object_3)  # IronPython2
# ---------- check_for_no_sheets_case.python (4 lines) ----------
if IN[0]==None or IN[0]==[] or IN[0]=="null" or IN[0]=="Unnamed":
	OUT = "__"
else:
	OUT = IN[0]
# ----------------------------------------
code_block_6 = CodeBlock { "Sheets"; }
byName_2 = Category.ByName(name=code_block_6)
all_elements_of_category_2 = ElementsOfCategory(Category=byName_2)
sheetNumber = Sheet.SheetNumber(sheet=all_elements_of_category_2)
empty_list_check = Python(IN[0]=sheetNumber)  # IronPython2
# ---------- empty_list_check.python (5 lines) ----------
x = IN[0]

if x == []:
	OUT = ["A01"]
else: OUT = IN[0]
# ----------------------------------------
active_view_2 = Python()  # IronPython2; unwired: IN[0]; same code as active_view
code_block_7 = CodeBlock { "Sheet Number"; }
parameterByName_3 = Parameter.ParameterByName(element=active_view_2, name=code_block_7)
string_from_object_4 = FromObject(obj=parameterByName_3)
code_block_8 = CodeBlock { "Sheet Number : "; }
split_3 = String.Split(str=string_from_object_4, separator0=code_block_8)
firstItem_2 = List.FirstItem(list=split_3)
get_letters = Python(IN[0]=firstItem_2)  # IronPython2
# ---------- get_letters.python (12 lines) ----------
x = IN[0]
z = []
for i in x:
	if i.isalpha()==True:	
		z.append(str(i))

if len(z)==0:
	z="no_letters"
		
		
		
OUT = ''.join(z)
# ----------------------------------------
watch = Watch(get_letters)
check_latest = Python(IN[0]=empty_list_check, IN[1]=watch)  # IronPython2
# ---------- check_latest.python (30 lines) ----------
#check if the latest element is actually the latest
x = IN[0]
current_sheet_prefix =IN[1]

no_letters = []
one_letter = []
two_letters = []
three_letters = []
four_letters = []

#>>>>>make different list for STR and ARCH sets
# first check: isalpha, second: is not dot, third: next after is int, forth: we have proper prefix
for i in x:
	if i[:1].isalpha() == True and i[:2].isalpha() != True and i[:1] == current_sheet_prefix:
		one_letter.append(i[1:])
	elif i[1:2].isalpha() == True and i[1:2]!="." and i[2:3].isalpha() != True and i[:2] == current_sheet_prefix:
		two_letters.append(i[2:])
	elif i[2:3].isalpha() == True and i[2:3]!="." and i[3:4].isalpha() != True and i[:3] == current_sheet_prefix:
		three_letters.append(i[3:])
	elif i[3:4].isalpha() == True and i[3:4]!="." and i[4:5].isalpha() != True and i[:4] == current_sheet_prefix:
		four_letters.append(i[4:])				
	elif i[:1].isdigit() == True and current_sheet_prefix == "no_letters":
		no_letters.append(i)
		
output = no_letters + one_letter+ two_letters + three_letters + four_letters
#<<<<<



OUT = output
# ----------------------------------------
get_numbers_avoid_2_1a = Python(IN[0]=check_latest)  # IronPython2
# ---------- get_numbers_avoid_2_1a.python (16 lines) ----------
x = IN[0]
z = []
mm = []

for k in x:
	for i in k:
		if i.isalpha()!=True:	
			z.append(i)
		elif i == ".":
			z.append(i)
		cc = ''.join(z)
	mm.append(cc)
	z = [] #to reboot
	cc = []	#to reboot	
		
OUT = mm
# ----------------------------------------
get_numbers = Python(IN[0]=firstItem_2)  # IronPython2
# ---------- get_numbers.python (11 lines) ----------
x = IN[0]
z = []
for i in x:
	if i.isalpha()!=True:	
		z.append(str(i))
	elif i == ".":
		z.append(str(i))
		
		
		
OUT = ''.join(z)
# ----------------------------------------
split_get_first = Python(IN[0]=get_numbers)  # IronPython2
# ---------- split_get_first.python (10 lines) ----------
x = IN[0]


if "." in x:
	OUT = str(x.split(".")[0])
else: 
	if len(x) == 1:
		OUT = str("0"+x)
	else: OUT = x
	
# ----------------------------------------
watch_2 = Watch(split_get_first)
check_latest_2 = Python(IN[0]=get_numbers_avoid_2_1a, IN[1]=watch_2, IN[2]=firstItem_2)  # IronPython2
# ---------- check_latest_2.python (32 lines) ----------
output = IN[0]
first_number = IN[1]
original = IN[2]

maxx = []

#<<<<< check situation with dot
if "." in original:
	# check first number
	new_list = []
	for i in output:
		if  i.split(".")[0] == first_number:
			new_list.append(i)
	last_digits = []
	for i in new_list:
		last_digits.append(int(i.split(".")[1]))
	max_from_last = max(last_digits)
	if len(original.split(".")[1])==2 and max_from_last<10:
		maxx = str(first_number) + ".0" + str(max_from_last)
	else:
		maxx = str(first_number) + "." + str(max_from_last)	
	
else: #no dots
	digits = []
	for i in output:
		digits.append(int(i.split(".")[0]))	
		max_no_letter= max(digits)
		maxx = str(max_no_letter)
#>>>>>>>>>>>>


OUT = maxx
# ----------------------------------------
watch_3 = Watch(check_latest_2)
string_from_object_5 = FromObject(obj=watch_3)
string_from_object_6 = FromObject(obj=watch_2)
empty_list_check_2 = Python(IN[0]=string_from_object_5, IN[1]=string_from_object_6)  # IronPython2
# ---------- empty_list_check_2.python (9 lines) ----------
x = IN[0]
y = IN[1]

if any([x == [], str(x) == "null"]):
	if all([y !="---",  y !=[], y !="null"]):
		OUT = y
	else: OUT = "00"	
		
else: OUT = IN[0]
# ----------------------------------------
code_block_9 = CodeBlock { "."; }
split_4 = String.Split(str=empty_list_check_2, separator0=code_block_9)
get_letters_2 = Python(IN[0]=firstItem_2)  # IronPython2
# ---------- get_letters_2.python (11 lines) ----------
x = IN[0]
z = []
for i in x:
	if i.isalpha()==True:	
		z.append(str(i))
if len(z)==0:
	z=""
		
		
		
OUT = ''.join(z)
# ----------------------------------------
watch_4 = Watch(get_letters_2)
firstItem_3 = List.FirstItem(list=split_4)
watch_5 = Watch(firstItem_3)
check_for_for_x_xx = Python(IN[0]=empty_list_check_2)  # IronPython2
# ---------- check_for_for_x_xx.python (6 lines) ----------
x = IN[0]
y = x.split(".")[1]

if len(y) ==2 :
	OUT =  y
else: OUT = []
# ----------------------------------------

# group: Name in format A0.00
code_block_10 = CodeBlock { "."; }
concat = String.Concat(string0=watch_5, string1=code_block_10)
toNumber = String.ToNumber(str=check_for_for_x_xx)
code_block_11 = CodeBlock { 9; }
lt = toNumber < code_block_11
code_block_12 = CodeBlock { "0"; }
code_block_13 = CodeBlock { 1; }
add = toNumber + code_block_13
string_from_object_7 = FromObject(obj=add)
concat_2 = String.Concat(string0=code_block_12, string1=string_from_object_7)
code_block_14 = CodeBlock { 1; }
add_2 = toNumber + code_block_14
if_ = If(test=lt, true=concat_2, false=add_2)
string_from_object_8 = FromObject(obj=if_)
concat_3 = String.Concat(string0=concat, string1=string_from_object_8)

concat_4 = Python(IN[0]=watch_4, IN[1]=concat_3)  # IronPython2
# ---------- concat_4.python (6 lines) ----------
x = IN[0]
y = str(IN[1])

if x is not None:
	OUT = x+y
else: OUT = y
# ----------------------------------------
watch_6 = Watch(firstItem_3)
check_for_for_x_x = Python(IN[0]=empty_list_check_2)  # IronPython2
# ---------- check_for_for_x_x.python (5 lines) ----------
x = IN[0]
y = x.split(".")[1]
if len(y) ==1 and int(y)<10:
	OUT =  y
else: OUT = []
# ----------------------------------------

# group: Name in format A0.0
code_block_15 = CodeBlock { "."; }
concat_5 = String.Concat(string0=watch_6, string1=code_block_15)
toNumber_2 = String.ToNumber(str=check_for_for_x_x)

python_script = Python(IN[0]=toNumber_2)  # IronPython2
# ---------- python_script.python (4 lines) ----------
x = IN[0]

if int(x)<10:
	OUT = str(int(x)+1)
# ----------------------------------------
watch_7 = Watch(python_script)

# group (continued): Name in format A0.0
concat_6 = String.Concat(string0=concat_5, string1=watch_7)

concat_7 = Python(IN[0]=watch_4, IN[1]=concat_6)  # IronPython2; same code as concat_4

# group: scenario selector
watch_8 = Watch(concat_4)
watch_9 = Watch(concat_7)
check_for_0_0_vs_0_00 = Python(IN[0]=watch_8, IN[1]=watch_9)  # IronPython2
# ---------- check_for_0_0_vs_0_00.python (5 lines) ----------
x = IN[0]
y = IN[1]
if any(["[" in x, "null" in x]):
	OUT =  y
else: OUT = x
# ----------------------------------------

# group: Name in format A0
toNumber_3 = String.ToNumber(str=firstItem_3)
code_block_16 = CodeBlock { 9; }
lt_2 = toNumber_3 < code_block_16
code_block_17 = CodeBlock { "0"; }
code_block_18 = CodeBlock { 1; }
add_3 = toNumber_3 + code_block_18
string_from_object_9 = FromObject(obj=add_3)
concat_8 = String.Concat(string0=code_block_17, string1=string_from_object_9)
code_block_19 = CodeBlock { 1; }
add_4 = toNumber_3 + code_block_19
if_2 = If(test=lt_2, true=concat_8, false=add_4)

concat_9 = Python(IN[0]=watch_4, IN[1]=if_2)  # IronPython2; same code as concat_4

# group: Two scenarios selector
count = List.Count(list=split_4)
code_block_20 = CodeBlock { 1; }
gt = count > code_block_20
if_3 = If(test=gt, true=check_for_0_0_vs_0_00, false=concat_9)

watch_10 = Watch(if_3)
code_block_21 = CodeBlock { "TitleBlocks"; }
byName_3 = Category.ByName(name=code_block_21)
all_elements_of_category_3 = ElementsOfCategory(Category=byName_3)
string = StringInput("Sheet Number")
getParameterValueByName = Element.GetParameterValueByName(element=all_elements_of_category_3, parameterName=string)
watch_11 = Watch(firstItem_2)
watch_12 = Watch(watch_11)
code_block_22 = CodeBlock(active_view_sheet_number=watch_12) { active_view_sheet_number; }
python_script_2 = Python(IN[0]=getParameterValueByName, IN[1]=code_block_22, IN[2]=all_elements_of_category_3)  # IronPython2
# ---------- python_script_2.python (2 lines) ----------
for i in range(len(IN[2])):
	if IN[0][i]==IN[1]: OUT = IN[2][i]
# ----------------------------------------
titleblock_names_to_exclude = CodeBlock { []; }
create = Python(IN[0]=check_for_no_sheets_case, IN[1]=watch_10, IN[2]=python_script_2, IN[3]=titleblock_names_to_exclude)  # "Sheet.Create"; IronPython2
# ---------- create.python (88 lines) ----------
import clr

clr.AddReference("RevitServices")
import RevitServices
from RevitServices.Persistence import DocumentManager
from RevitServices.Transactions import TransactionManager

clr.AddReference("RevitAPI")
import Autodesk
from Autodesk.Revit.DB import *

name = IN[0]
number = IN[1]
e_title = UnwrapElement(IN[2])
ex = IN[3]


doc = DocumentManager.Instance.CurrentDBDocument
uidoc = DocumentManager.Instance.CurrentUIDocument

TransactionManager.Instance.EnsureInTransaction(doc)


#>>>>create a filter to get all the title block type
vv = FilteredElementCollector(doc).OfCategory(BuiltInCategory.OST_TitleBlocks).WhereElementIsElementType().ToElements()


vv_ids = []
for elem in vv:
	vv_ids.append(elem.Id) 



if e_title !=None:
	for i in range(len(vv)):
		if e_title.GetTypeId() == vv_ids[i]:
			title=vv[i]
else:
#now starts script to find a proper Title block 
#IF NO SHEETS ARE MADE IN THE PROJECT
	descripciones = []
	for elem in vv:
		descripcion = elem.get_Parameter(BuiltInParameter.ALL_MODEL_FAMILY_NAME)
		descripciones.append(descripcion.AsString()) 
	
	jk = []
	for i in range(len(descripciones)):
		for j in range(len(ex)):
			if descripciones[i].find(ex[j])!=-1: 
				zf = True
		if zf == True: 
			jk.append(False)
		else: 
			jk.append(True)
		zf = []
	
	
	ist = zip(vv,jk)
	kg = []
	for i in ist:
		if i[1]==True:
			kg.append(i[0])
	
	#reverse
	zz = []
	i = len(kg) - 1 
	while i >= 0 :
	    zz.append(kg[i]) 
	    i -= 1
	
	
	title = doc.GetElement(zz[0].Id)



#>>>>>now create sheet
if title == None or title == [] or title =="null":
	x = ViewSheet.Create(doc, ElementId.InvalidElementId)
else:
	x = ViewSheet.Create(doc, title.Id)
	
x.SheetNumber = number
x.Name = name


TransactionManager.Instance.ForceCloseTransaction()

OUT = title,x
# ----------------------------------------
lastItem_3 = List.LastItem(list=create)
thomasmahon_epic_script = Python(IN[0]=lastItem_3)  # IronPython2
# ---------- thomasmahon_epic_script.python (24 lines) ----------
#Copyright 2016. All rights reserved. Bimorph Consultancy LTD, 5 St Johns Lane, London EC1M 4BH www.bimorph.co.uk
#Written by Thomas Mahon @Thomas__Mahon info@bimorph.co.uk Package: bimorphNodes
#GitHub: https://github.com/ThomasMahon/bimorphNodes/
#Follow: facebook.com/bimorphBIM | linkedin.com/company/bimorph-bim | @bimorphBIM

import clr

clr.AddReference("RevitServices")
import RevitServices
from RevitServices.Persistence import DocumentManager
from RevitServices.Transactions import TransactionManager

clr.AddReference("RevitAPI")
import Autodesk
from Autodesk.Revit.DB import *

doc = DocumentManager.Instance.CurrentDBDocument
uidoc = DocumentManager.Instance.CurrentUIDocument

TransactionManager.Instance.EnsureInTransaction(doc)
TransactionManager.Instance.ForceCloseTransaction()

view = UnwrapElement(IN[0])
uidoc.RequestViewChange( view )
# ----------------------------------------
watch_13 = Watch(get_numbers_avoid_2_1a)
watch_14 = Watch(create)  # graph output
titleblock_names_to_exclude_2 = CodeBlock()
# ---------- titleblock_names_to_exclude_2.designscript (10 lines) ----------
[
"cover",
"project",
"title list",
"sheet_formats",
"project_title",
"Shearer",
"A1",
"A2"
];
# ----------------------------------------
