# Dynamo graph Sheets_END_to_rename.dyn (Dynamo 2.10.1.3976)

code_block = CodeBlock { "Sheets"; }
byName = Category.ByName(name=code_block)
all_elements_of_category = ElementsOfCategory(Category=byName)

# group: Filter existing sheets to find required
code_block_2 = CodeBlock { "Sheet Number"; }
parameterByName = Parameter.ParameterByName(element=all_elements_of_category, name=code_block_2)
string_from_object = FromObject(obj=parameterByName)
code_block_3 = CodeBlock { " : "; }
split = String.Split(str=string_from_object, separator0=code_block_3)
code_block_4 = CodeBlock { 2; }
code_block_5 = CodeBlock { -1; }
dropEveryNthItem = List.DropEveryNthItem(list=split, n=code_block_4, offset=code_block_5, lacing=Longest)
flatten = List.Flatten(list=dropEveryNthItem)
boolean = BoolSelector(true)

sorted = Python(IN[0]=all_elements_of_category, IN[1]=flatten)  # IronPython2
# ---------- sorted.python (12 lines) ----------
inp = IN[0]
sorting = IN[1]


zipped = zip(sorting,inp)

sorted_zipped_lists = sorted(zipped)

#crazy way to get the second element fom any sublist
sorted_list1 = [element for _, element in sorted_zipped_lists]

OUT = sorted_list1 
# ----------------------------------------

# group (continued): Filter existing sheets to find required
watch = Watch(sorted)

sorted_2 = Python(IN[0]=flatten)  # IronPython2
# ---------- sorted_2.python (1 lines) ----------
OUT = sorted(IN[0])
# ----------------------------------------

# group: Input
run = BoolSelector(true)
user_input = Python(IN[0]=run)  # IronPython2
# ---------- user_input.python (95 lines) ----------
""" DynamoFormInput: TextInput
Ported from RevitPythonWrapper:
https://github.com/gtalarico/revitpythonwrapper
@gtalarico
"""

import clr
import sys
#sys.path.append(r'C:\Program Files (x86)\IronPython 2.7\Lib')
#sys.path.append(r'C:\Program Files (x86)\IronPython 2.7\Platforms\Net40')

try:
	clr.AddReference('System')
	clr.AddReference("PresentationFramework")
	clr.AddReference('IronPython.Wpf')
except IOError:
	raise

from System.Windows import Application, Window
from System.IO import StringReader

try:
	import wpf    
except ImportError:
	raise

class TextInput(Window):
    """
    WPF form with TextInput.

    Args:
        title (str): Title of form
        default ([str]): Default value for text box
        description (str): Description of input requested


    Usage:
        >>> prompt = TextInput('Title', default="3")
        >>> prompt.show()
        >>> print(prompt.selected)
    """

    LAYOUT = """
            <Window xmlns="http://schemas.microsoft.com/winfx/2006/xaml/presentation"
                    xmlns:x="http://schemas.microsoft.com/winfx/2006/xaml"
                    xmlns:d="http://schemas.microsoft.com/expression/blend/2008"
                    xmlns:mc="http://schemas.openxmlformats.org/markup-compatibility/2006"
                    xmlns:local="clr-namespace:WpfApplication1"
                    mc:Ignorable="d" Height="0" Width="325" ResizeMode="NoResize" Title="" WindowStartupLocation="CenterScreen" Topmost="True" SizeToContent="WidthAndHeight">
                <Grid Margin="20,0,20,20">
                    <Label x:Name="selection_label" Content="Rename from: (example A1.04)" HorizontalAlignment="Center" Height="50" VerticalAlignment="Top" Width="200"/>

                    <TextBox x:Name="text_box" HorizontalAlignment="Left" Margin="0,25,0,0" VerticalAlignment="Top" Width="200"/>
                    
                    <Label x:Name="selection_label2" Content="+x or -x sheets: (type -2 >>> A1.02)" HorizontalAlignment="Center" Height="45" VerticalAlignment="Center" Width="200"/>
                    
                   <TextBox x:Name="text_box2" HorizontalAlignment="Left" Margin="0,65,0,0" VerticalAlignment="Top" Width="200"/>
                   
                    <Button x:Name="button_select" Content="Rename!" HorizontalAlignment="Left" Height="26" Margin="0,100,0,0" VerticalAlignment="Top" Width="200"/>

                </Grid>
            </Window>
            """

    def __init__(self, title, default=None, description=None):
        self.selected = None
        self.ui = wpf.LoadComponent(self, StringReader(TextInput.LAYOUT))
        self.ui.Title = title

        if default is not None:
            self.ui.text_box.Text = default

        if description is not None:
            self.ui.selection_label.Content = description
        self.ui.button_select.Click += self.select_click

    def select_click(self, sender, e):
        self.DialogResult = True
        self.selected = [self.ui.text_box.Text,self.ui.text_box2.Text]
        self.Close()

###################################################################
# Dynamo Interface for RPW Form
###################################################################

run = IN[0]

if run:
	form = TextInput('Input')
	form.ShowDialog()
	if form.selected is not None:
		OUT = form.selected
else:
	OUT = 'Set RUN to True'
	
# ----------------------------------------
watch_2 = Watch(user_input)
rename_from = CodeBlock(x=watch_2) { x[0]; }
x_or_x_sheets = CodeBlock(x=watch_2) { x[1]; }

watch_3 = Watch(rename_from)
beginning = Python(IN[0]=watch_3)  # IronPython2
# ---------- beginning.python (13 lines) ----------
if isinstance(IN[0], list): x = IN[0]
else: x = [IN[0]]
z = []

if "." in x[0]: 
	for i in x:
		z.append(i.split(".")[0])
else: 
	for i in x:
		z.append(filter(str.isalpha, i[:-1])) #x[:-1] to avoid situations where a letter at the end


OUT = z
# ----------------------------------------
code_block_6 = CodeBlock(x=beginning) { x[0]; }
check_for_special_symbol = Python(IN[0]=watch_3)  # IronPython2
# ---------- check_for_special_symbol.python (8 lines) ----------
x = IN[0]
z = ""
if "." in x: z = "."
else: 
	z = ""


OUT = z
# ----------------------------------------
end = Python(IN[0]=watch_3)  # IronPython2
# ---------- end.python (14 lines) ----------
if isinstance(IN[0], list):
	x = IN[0]
else: x = [IN[0]]
z = []

if "." in x[0]: 
	for i in x:
		z.append(int(i.split(".")[1]))
else: 
	for i in x:
		z.append(int(filter(str.isdigit, i)))


OUT = z
# ----------------------------------------
code_block_7 = CodeBlock(x=end) { x[0]; }
up_to_n_sheets = List.Count(list=parameterByName)
add = code_block_7 + up_to_n_sheets

# group: generating list required to rename
code_block_8 = CodeBlock { "0"; }
code_block_9 = CodeBlock { 1; }
code_block_10 = CodeBlock(first=code_block_7, second=add, spc=code_block_9) { first..second..~spc; }
code_block_11 = CodeBlock { 10; }
lt = code_block_10 < code_block_11
filterByBoolMask = List.FilterByBoolMask(list=code_block_10, mask=lt)
watch_4 = Watch(filterByBoolMask.in)
code_block_12 = CodeBlock(one=code_block_6, two=check_for_special_symbol, three=code_block_8, four=watch_4) { one+two+three+four; }
code_block_13 = CodeBlock { 9; }
gt = code_block_10 > code_block_13
filterByBoolMask_2 = List.FilterByBoolMask(list=code_block_10, mask=gt)
code_block_14 = CodeBlock(one=code_block_6, two=check_for_special_symbol, three=filterByBoolMask_2.in) { one+two+three; }
list_create = List.Create(item0=code_block_12, item1=code_block_14)
flatten_2 = List.Flatten(list=list_create)

# group (continued): Filter existing sheets to find required
contains = List.Contains(list=sorted_2, item=flatten_2, lacing=CrossProduct)
contains_2 = List.Contains(list=contains, item=boolean, lacing=Longest)
filterByBoolMask_3 = List.FilterByBoolMask(list=watch, mask=contains_2)
watch_5 = Watch(filterByBoolMask_3.in)

watch_6 = Watch(watch_5)

# group: getting sheets numbers
code_block_15 = CodeBlock { "Sheet Number"; }
parameterByName_2 = Parameter.ParameterByName(element=watch_5, name=code_block_15)
string_from_object_2 = FromObject(obj=parameterByName_2)
code_block_16 = CodeBlock { " : "; }
split_2 = String.Split(str=string_from_object_2, separator0=code_block_16)
code_block_17 = CodeBlock { 2; }
code_block_18 = CodeBlock { -1; }
dropEveryNthItem_2 = List.DropEveryNthItem(list=split_2, n=code_block_17, offset=code_block_18, lacing=Longest)
flatten_3 = List.Flatten(list=dropEveryNthItem_2)

rand = Math.Rand()
code_block_19 = CodeBlock { 1000; }
mul = rand * code_block_19

# group: +x in the same order
beginning_2 = Python(IN[0]=flatten_3)  # IronPython2; same code as beginning
end_2 = Python(IN[0]=flatten_3)  # IronPython2; same code as end
ceiling = Math.Ceiling(number=mul)
code_block_20 = CodeBlock(one=beginning_2, two=end_2, three=ceiling) { one+two+three; }

# group: fake rename to avoid error
setParameterByName = Element.SetParameterByName(element=watch_6, parameterName=code_block_15, value=code_block_20)

watch_7 = Watch(x_or_x_sheets)

# group: +/- number in the same order
beginning_3 = Python(IN[0]=flatten_3)  # IronPython2; same code as beginning
check_for_special_symbol_2 = Python(IN[0]=flatten_3)  # IronPython2
# ---------- check_for_special_symbol_2.python (8 lines) ----------
x = IN[0][0]
z = ""
if "." in x: z = "."
else: 
	z = ""


OUT = z
# ----------------------------------------
code_block_21 = CodeBlock { "0"; }
end_3 = Python(IN[0]=flatten_3)  # IronPython2; same code as end
toNumber = String.ToNumber(str=watch_7)
add_2 = end_3 + toNumber
code_block_22 = CodeBlock { 10; }
lt_2 = add_2 < code_block_22
filterByBoolMask_4 = List.FilterByBoolMask(list=add_2, mask=lt_2)
watch_8 = Watch(filterByBoolMask_4.in)
code_block_23 = CodeBlock(one=beginning_3, two=check_for_special_symbol_2, three=code_block_21, four=watch_8) { one+two+three+four; }
code_block_24 = CodeBlock { 9; }
gt_2 = add_2 > code_block_24
filterByBoolMask_5 = List.FilterByBoolMask(list=add_2, mask=gt_2)
code_block_25 = CodeBlock(one=beginning_3, two=check_for_special_symbol_2, three=filterByBoolMask_5.in) { one+two+three; }
list_create_2 = List.Create(item0=code_block_23, item1=code_block_25)
flatten_4 = List.Flatten(list=list_create_2)

setParameterByName_2 = Element.SetParameterByName(element=setParameterByName, parameterName=code_block_15, value=flatten_4)
