# Dynamo graph Sheets_PREFIX_to_rename.dyn (Dynamo 2.10.1.3976)

code_block = CodeBlock { "Sheets"; }
byName = Category.ByName(name=code_block)
all_elements_of_category = ElementsOfCategory(Category=byName)
watch = Watch(all_elements_of_category)
code_block_2 = CodeBlock { "Sheet Number"; }
parameterByName = Parameter.ParameterByName(element=all_elements_of_category, name=code_block_2)
string_from_object = FromObject(obj=parameterByName)
code_block_3 = CodeBlock { " : "; }
split = String.Split(str=string_from_object, separator0=code_block_3)
code_block_4 = CodeBlock { 2; }
code_block_5 = CodeBlock { -1; }
dropEveryNthItem = List.DropEveryNthItem(list=split, n=code_block_4, offset=code_block_5, lacing=Longest)
flatten = List.Flatten(list=dropEveryNthItem)

# group: Input
run = BoolSelector(true)
user_input = Python(IN[0]=run)  # IronPython2
# ---------- user_input.python (95 lines) ----------
""" DynamoFormInput: TextInput
Ported from RevitPythonWrapper:
https://github.com/gtalarico/revitpythonwrapper
@gtalarico
"""

import clr
import sys
#sys.path.append(r'C:\Program Files (x86)\IronPython 2.7\Lib')
#sys.path.append(r'C:\Program Files (x86)\IronPython 2.7\Platforms\Net40')

try:
	clr.AddReference('System')
	clr.AddReference("PresentationFramework")
	clr.AddReference('IronPython.Wpf')
except IOError:
	raise

from System.Windows import Application, Window
from System.IO import StringReader

try:
	import wpf    
except ImportError:
	raise

class TextInput(Window):
    """
    WPF form with TextInput.

    Args:
        title (str): Title of form
        default ([str]): Default value for text box
        description (str): Description of input requested


    Usage:
        >>> prompt = TextInput('Title', default="3")
        >>> prompt.show()
        >>> print(prompt.selected)
    """

    LAYOUT = """
            <Window xmlns="http://schemas.microsoft.com/winfx/2006/xaml/presentation"
                    xmlns:x="http://schemas.microsoft.com/winfx/2006/xaml"
                    xmlns:d="http://schemas.microsoft.com/expression/blend/2008"
                    xmlns:mc="http://schemas.openxmlformats.org/markup-compatibility/2006"
                    xmlns:local="clr-namespace:WpfApplication1"
                    mc:Ignorable="d" Height="0" Width="325" ResizeMode="NoResize" Title="" WindowStartupLocation="CenterScreen" Topmost="True" SizeToContent="WidthAndHeight">
                <Grid Margin="20,0,20,20">
                    <Label x:Name="selection_label" Content="Rename PREFIX: (example A1)" HorizontalAlignment="Center" Height="50" VerticalAlignment="Top" Width="200"/>

                    <TextBox x:Name="text_box" HorizontalAlignment="Left" Margin="0,25,0,0" VerticalAlignment="Top" Width="200"/>
                    
                    <Label x:Name="selection_label2" Content="Rename to: (example S2)" HorizontalAlignment="Center" Height="45" VerticalAlignment="Center" Width="200"/>
                    
                   <TextBox x:Name="text_box2" HorizontalAlignment="Left" Margin="0,65,0,0" VerticalAlignment="Top" Width="200"/>
                   
                    <Button x:Name="button_select" Content="Rename!" HorizontalAlignment="Left" Height="26" Margin="0,100,0,0" VerticalAlignment="Top" Width="200"/>

                </Grid>
            </Window>
            """

    def __init__(self, title, default=None, description=None):
        self.selected = None
        self.ui = wpf.LoadComponent(self, StringReader(TextInput.LAYOUT))
        self.ui.Title = title

        if default is not None:
            self.ui.text_box.Text = default

        if description is not None:
            self.ui.selection_label.Content = description
        self.ui.button_select.Click += self.select_click

    def select_click(self, sender, e):
        self.DialogResult = True
        self.selected = [self.ui.text_box.Text,self.ui.text_box2.Text]
        self.Close()

###################################################################
# Dynamo Interface for RPW Form
###################################################################

run = IN[0]

if run:
	form = TextInput('Input')
	form.ShowDialog()
	if form.selected is not None:
		OUT = form.selected
else:
	OUT = 'Set RUN to True'
	
# ----------------------------------------
watch_2 = Watch(user_input)
rename_from = CodeBlock(x=watch_2) { x[0]; }
rename_to = CodeBlock(x=watch_2) { x[1]; }

watch_3 = Watch(rename_from)
code_block_6 = CodeBlock { ".0"; }
number = DoubleInput(1)
number_2 = DoubleInput(9)
code_block_7 = CodeBlock { 1; }
code_block_8 = CodeBlock(first=number, second=number_2, spc=code_block_7) { first..second..~spc; }
code_block_9 = CodeBlock(one=watch_3, two=code_block_6, three=code_block_8) { one+two+three; }
code_block_10 = CodeBlock { "."; }
number_3 = DoubleInput(10)
up_to_n_sheets = List.Count(list=parameterByName)
code_block_11 = CodeBlock { 1; }
code_block_12 = CodeBlock(first=number_3, second=up_to_n_sheets, spc=code_block_11) { first..second..~spc; }
code_block_13 = CodeBlock(one=watch_3, two=code_block_10, three=code_block_12) { one+two+three; }
list_create = List.Create(item0=code_block_9, item1=code_block_13)
flatten_2 = List.Flatten(list=list_create)
contains = List.Contains(list=flatten, item=flatten_2, lacing=CrossProduct)
boolean = BoolSelector(true)
contains_2 = List.Contains(list=contains, item=boolean, lacing=Longest)
filterByBoolMask = List.FilterByBoolMask(list=watch, mask=contains_2)
watch_4 = Watch(filterByBoolMask.in)
code_block_14 = CodeBlock { "Sheet Number"; }
parameterByName_2 = Parameter.ParameterByName(element=watch_4, name=code_block_14)
string_from_object_2 = FromObject(obj=parameterByName_2)
code_block_15 = CodeBlock { " : "; }
split_2 = String.Split(str=string_from_object_2, separator0=code_block_15)
code_block_16 = CodeBlock { 2; }
code_block_17 = CodeBlock { -1; }
dropEveryNthItem_2 = List.DropEveryNthItem(list=split_2, n=code_block_16, offset=code_block_17, lacing=Longest)
flatten_3 = List.Flatten(list=dropEveryNthItem_2)
watch_5 = Watch(watch_3)
watch_6 = Watch(rename_to)
watch_7 = Watch(watch_6)
replace = String.Replace(string=flatten_3, searchFor=watch_5, replaceWith=watch_7)
setParameterByName = Element.SetParameterByName(element=watch_4, parameterName=code_block_14, value=replace)
