# Dynamo graph Text_Merge.dyn (Dynamo 2.6.1.8786)

boolean = BoolSelector(true)
active_view = Python(IN[0]=boolean)
# ---------- active_view.python (14 lines) ----------
#Copyright(c) 2016, Dimitar Venkov
# @5devene, dimitar.ven@gmail.com

import clr

clr.AddReference("RevitServices")
import RevitServices
from RevitServices.Persistence import DocumentManager
doc = DocumentManager.Instance.CurrentDBDocument
clr.AddReference("RevitNodes")
import Revit
clr.ImportExtensions(Revit.Elements)

OUT = doc.ActiveView.ToDSType(True)
# ----------------------------------------
select_model_elements = DSModelElementsSelection()  # 40 picked in the model; graph input
code_block = CodeBlock { "Text notes"; }
byCategoryName = Python(IN[0]=select_model_elements, IN[1]=code_block)  # "Springs.Filter.ByCategoryName"
# ---------- byCategoryName.python (24 lines) ----------
#Copyright(c) 2016, Dimitar Venkov
# @5devene, dimitar.ven@gmail.com

import clr

clr.AddReference("RevitNodes")
import Revit
clr.ImportExtensions(Revit.Elements)

def tolist(obj1):
	if hasattr(obj1,"__iter__"): return obj1
	else: return [obj1]

elements = UnwrapElement(tolist(IN[0]))
filter = tolist(IN[1])
in1, out1 = [], []

for i in xrange(len(elements)):
	try: n1 = elements[i].Category.Name.lower()
	except: n1 = ""
	if any(filter[j].lower() in n1 for j in xrange(len(filter))):
		in1.append(elements[i])
	else: out1.append(elements[i])
OUT = in1, out1
# ----------------------------------------
firstItem = List.FirstItem(list=byCategoryName)
watch = Watch(firstItem)
text_coordynates = Python(IN[0]=watch)
# ---------- text_coordynates.python (25 lines) ----------
# Importing the 'Common Language Runtime' library
import clr
# Adding specific references: The Revit API
clr.AddReference('RevitAPI')
from Autodesk.Revit.DB import *
clr.AddReference('RevitNodes')
import Revit
# Importing specific extension methods that allow us to gain
# information such as 'Coord' data
clr.ImportExtensions(Revit.GeometryConversion)
clr.ImportExtensions(Revit.Elements)
# Creating an empty list that we populate later
OUT = []
# Running a 'for loop' over everything inside our input list
# by Unwrapping them (Which is requried between Revit and Dynamo
# objects
for item in UnwrapElement(IN[0]):
    # For our 'for loop' to work, we need to indent as Python is 
    # very particular about indentation. We simply then 'nest' in
    # our line of code an appendation of each 'looped' item into
    # our previously created empty list. We then 'cast' the data
    # to a Point (Which dynamo can read)
    OUT.append(item.Coord.ToPoint())
    # Natively, Dynamo understands that the OUT is our output, so
    # pushes this data through the node out port
# ----------------------------------------

# group: Group location points by distance and sort by X and Y and left to right and top to bottom
code_block_2 = CodeBlock { 1.25; }
X = Point.X()  # unwired: point
Y = Point.Y()  # unwired: point

ꟿ_geometry_groupbydistance = Python(IN[0]=text_coordynates, IN[1]=code_block_2)
# ---------- ꟿ_geometry_groupbydistance.python (26 lines) ----------
#Copyright(c) 2016, Dimitar Venkov
# @5devene, dimitar.ven@gmail.com
#Inspired from the "Group Curves" node by Konrad Sobon
# @arch_laboratory, http://archi-lab.net

import clr
clr.AddReference('ProtoGeometry')
from Autodesk.DesignScript.Geometry import Geometry

pts = IN[0]
margin = IN[1]
dist1 = Geometry.DistanceTo

Groups, Queue = [], []
while pts:
	group = []
	Queue.append(pts.pop() )
	while Queue:
		p1 = Queue.pop()
		group.append(p1)
		for i in xrange(len(pts)-1,-1,-1):
			if dist1(p1, pts[i]) <= margin:
				Queue.append(pts.pop(i) )
	Groups.append(group)

OUT = Groups
# ----------------------------------------

# group (continued): Group location points by distance and sort by X and Y and left to right and top to bottom
sortByFunction = List.SortByFunction(list=ꟿ_geometry_groupbydistance@L2, func=X)
reverse = List.Reverse(list=sortByFunction)
sortByFunction_2 = List.SortByFunction(list=reverse@L2, func=Y)
reverse_2 = List.Reverse(list=sortByFunction_2@L2)

flatten = List.Flatten(list=sortByFunction_2)

# group: Get text notes and locations
text = TextNote.Text(textNote=watch)
trimTrailingWhitespace = String.TrimTrailingWhitespace(str=text)

flatten_2 = List.Flatten(list=reverse_2)
byKeysValues = Python(IN[0]=text_coordynates, IN[1]=trimTrailingWhitespace, IN[2]=flatten_2)  # "Springs.Dictionary.ByKeysValues"
# ---------- byKeysValues.python (18 lines) ----------
#Copyright(c) 2016, Dimitar Venkov
# @5devene, dimitar.ven@gmail.com

def tolist(obj1):
	if hasattr(obj1,"__iter__"): return obj1
	else: return [obj1]

out1 = []

keys = tolist(IN[0])
elements = tolist(IN[1])
searchVals = tolist(IN[2])
dict1 = dict(zip(keys,elements))
for i in xrange(len(searchVals)):
	if searchVals[i] in dict1: out1.append(dict1[searchVals[i]])
	else: out1.append(None)

OUT = out1
# ----------------------------------------

# group: Return text by points
code_block_3 = CodeBlock { " "; }
join = String.Join(separator=code_block_3, string0=byKeysValues)

code_block_4 = CodeBlock { "Text Notes"; }
byName = Category.ByName(name=code_block_4)
all_elements_of_category = ElementsOfCategory(Category=byName)
lastItem = List.LastItem(list=all_elements_of_category)
typename = TextNote.Typename(textNote=lastItem)
byName_2 = TextNoteType.ByName(name=typename)

# group: Create new text note
firstItem_2 = List.FirstItem(list=flatten@L2)
flatten_3 = List.Flatten(list=join)
code_block_5 = CodeBlock { "Left"; }
byLocation = TextNote.ByLocation(view=active_view, location=firstItem_2, text=flatten_3, alignment=code_block_5, type=byName_2)
