# Dynamo graph Text_toUppercase.dyn (Dynamo 2.6.1.8786)

select_model_elements = DSModelElementsSelection()  # 1 picked in the model
python_script = Python(IN[0]=select_model_elements)
# ---------- python_script.python (83 lines) ----------
import clr
clr.AddReference('ProtoGeometry')
from Autodesk.DesignScript.Geometry import *

# Import ToDSType(bool) extension method
clr.AddReference("RevitNodes")
import Revit
clr.ImportExtensions(Revit.Elements)

# Import DocumentManager and TransactionManager
clr.AddReference("RevitServices")
import RevitServices
from RevitServices.Persistence import DocumentManager
from RevitServices.Transactions import TransactionManager

from System.Collections.Generic import *

# Import RevitAPI
clr.AddReference("RevitAPI")
import Autodesk

from Autodesk.Revit.DB import *
import System

doc = DocumentManager.Instance.CurrentDBDocument
uiapp = DocumentManager.Instance.CurrentUIApplication
app = uiapp.Application

#The inputs to this node will be stored as a list in the IN variable.

#TransactionManager.Instance.EnsureInTransaction(doc)

#unwrap all elements to use with API
top_align = System.Enum.GetValues(LeaderAtachement)[0]

elements = []

if isinstance(IN[0], list):
	for i in IN[0]:
		elements.append(UnwrapElement(i))
	for i in elements:
		
		i.Text=i.Text.upper()
		i.Text = i.Text.replace("MM ", "mm ")
		i.Text = i.Text.replace(" MM", " mm")
		i.Text = i.Text.replace("0mm", "0 mm")
		i.Text = i.Text.replace("1mm", "1 mm")
		i.Text = i.Text.replace("2mm", "2 mm")
		i.Text = i.Text.replace("3mm", "3 mm")
		i.Text = i.Text.replace("4mm", "5 mm")
		i.Text = i.Text.replace("5mm", "5 mm")
		i.Text = i.Text.replace("6mm", "6 mm")
		i.Text = i.Text.replace("7mm", "7 mm")
		i.Text = i.Text.replace("8mm", "8 mm")
		i.Text = i.Text.replace("9mm", "9 mm")
		i.Text = i.Text.replace("UPVC", "uPVC")
		
		i.LeaderRightAttachment = top_align
		i.LeaderLeftAttachment = top_align
		
else: 
	elements = UnwrapElement(IN[0])
	
	elements.Text=elements.Text.upper()
	elements.Text = elements.Text.replace("MM ", "mm ")
	elements.Text = elements.Text.replace(" MM", " mm")
	elements.Text = elements.Text.replace("0mm", "0 mm")
	elements.Text = elements.Text.replace("1mm", "1 mm")
	elements.Text = elements.Text.replace("2mm", "2 mm")
	elements.Text = elements.Text.replace("3mm", "3 mm")
	elements.Text = elements.Text.replace("4mm", "5 mm")
	elements.Text = elements.Text.replace("5mm", "5 mm")
	elements.Text = elements.Text.replace("6mm", "6 mm")
	elements.Text = elements.Text.replace("7mm", "7 mm")
	elements.Text = elements.Text.replace("8mm", "8 mm")
	elements.Text = elements.Text.replace("9mm", "9 mm")
	elements.Text = elements.Text.replace("UPVC", "uPVC")	

	elements.LeaderRightAttachment = top_align
	elements.LeaderLeftAttachment = top_align

	
OUT = "done"
# ----------------------------------------
