# Dynamo graph Type_DELETE.dyn (Dynamo 2.6.1.8786)

select_model_elements = DSModelElementsSelection()  # 1 picked in the model; graph input
code_block = CodeBlock { "Type"; }
getParameterValueByName = Element.GetParameterValueByName(element=select_model_elements, parameterName=code_block)
code_block_2 = CodeBlock { "Viewports"; }
byName = Category.ByName(name=code_block_2)
all_elements_of_category = ElementsOfCategory(Category=byName)
code_block_3 = CodeBlock { "Type"; }
getParameterValueByName_2 = Element.GetParameterValueByName(element=all_elements_of_category, parameterName=code_block_3)
python_script = Python(IN[0]=getParameterValueByName, IN[1]=getParameterValueByName_2)
# ---------- python_script.python (9 lines) ----------
x = IN[0]
y = IN[1]


t = []
for i in y: 
	if x == i: t.append(i)
	
OUT = len(t)
# ----------------------------------------
all_elements_of_family_type = ElementsOfFamilyType(Family_Type=getParameterValueByName)
python_script_2 = Python(IN[0]=python_script, IN[1]=all_elements_of_family_type)
# ---------- python_script_2.python (8 lines) ----------
x = IN[0]
y = IN[1]

if y is not None:
	if isinstance(len(y),int):
		OUT = max(x, len(y))
	else: OUT = x
else: OUT = x
# ----------------------------------------
code_block_4 = CodeBlock { 2; }
ge = python_script_2 >= code_block_4
code_block_5 = CodeBlock { "Please, press SA and change the type you want to delete to any other and then do again"; }
if_ = If(test=ge, true=code_block_5, false=getParameterValueByName)
delete = Element.Delete(element=if_)
count = List.Count(list=all_elements_of_family_type)
delete_2 = Python()  # unwired: IN[0]
# ---------- delete_2.python (29 lines) ----------
# Load the Python Standard and DesignScript Libraries
import sys
import clr
clr.AddReference('ProtoGeometry')
from Autodesk.DesignScript.Geometry import *
clr.AddReference("RevitServices")
import RevitServices
from RevitServices.Persistence import DocumentManager
from RevitServices.Transactions import TransactionManager

clr.AddReference('RevitAPI')
from Autodesk.Revit.DB import *

doc = DocumentManager.Instance.CurrentDBDocument
uidoc=DocumentManager.Instance.CurrentUIApplication.ActiveUIDocument


to = UnwrapElement(IN[0])

#to = IN[0]

TransactionManager.Instance.EnsureInTransaction(doc)

doc.Delete(to.Id)

TransactionManager.Instance.TransactionTaskDone()


OUT = 0
# ----------------------------------------
pop_up_message = Python(IN[0]=if_)
# ---------- pop_up_message.python (16 lines) ----------
#This script pops up a dialog box with a message from the previous node.
import clr
clr.AddReference('RevitAPIUI')

from Autodesk.Revit.UI import TaskDialog

mainText = IN[0]
xx = str(mainText).split(".")[0]


messagePop = TaskDialog("Dynamo Player")
messagePop.MainContent = ""

OUT = "Success!"

messagePop.Show()
# ----------------------------------------
