# Dynamo graph View_DELETE_not_on_sheets.dyn (Dynamo 2.10.1.3976)

code_block = CodeBlock { "Views"; }
byName = Category.ByName(name=code_block)
all_elements_of_category = ElementsOfCategory(Category=byName)
string_from_object = FromObject(object=all_elements_of_category)
null_check = Python(IN[0]=string_from_object, IN[1]=all_elements_of_category)  # IronPython2
# ---------- null_check.python (12 lines) ----------
strings = IN[0]
list = IN[1]

elements = []


for a,b in zip(strings, list):	
	if a != "null":
		elements.append(b)

		
OUT = elements
# ----------------------------------------
code_block_2 = CodeBlock { "View Name"; }
getParameterValueByName = Element.GetParameterValueByName(element=null_check, parameterName=code_block_2)

# group: to exclude
code_block_3 = CodeBlock()
# ---------- code_block_3.designscript (6 lines) ----------
[
"Template",
"3D",
"USER ATTENTION",
"TEMPLATE"
];
# ----------------------------------------
comparator_to_excl_str_str = Python(IN[0]=getParameterValueByName, IN[1]=code_block_3, IN[2]=null_check)  # "comparator to EXCL (str,str,element)"; IronPython2
# ---------- comparator_to_excl_str_str.python (26 lines) ----------
x = IN[0]
y = IN[1]
z = IN[2]


#if you want to INCLUDE then swap jk.append(False) and jk.append(True)
jk = []
zf = []

for i in range(len(x)):
	for j in range(len(y)):
		if x[i].find(y[j])!=-1: 
			zf = True
	if zf == True:
		jk.append(False)
	else:
		jk.append(True)
	zf = []
	
ist = zip(z,jk)
kg = []
for i in ist:
	if i[1] ==True:
		kg.append(i[0])
	
OUT = kg
# ----------------------------------------

watch = Watch(comparator_to_excl_str_str)
code_block_4 = CodeBlock { "Sheet Number"; }
getParameterValueByName_2 = Element.GetParameterValueByName(element=watch, parameterName=code_block_4)
python = Python(IN[0]=getParameterValueByName_2)  # IronPython2
# ---------- python.python (8 lines) ----------
data = IN[0]

ss = []
for i in data:
	if i!="": ss.append(i)
	else: ss.append("False")

OUT = ss
# ----------------------------------------
python_2 = Python(IN[0]=python)  # IronPython2
# ---------- python_2.python (7 lines) ----------
data = IN[0]

ss = []
for i in data:
	if i!="---": ss.append(i)
	else: ss.append("False")
OUT = ss
# ----------------------------------------
python_script = Python(IN[0]=python_2)  # IronPython2
# ---------- python_script.python (8 lines) ----------
data = IN[0]

ss = []
for i in data:
	if i is not None: ss.append(i)
	else: ss.append("False")	

OUT = ss
# ----------------------------------------
python_script_2 = Python(IN[0]=python_script)  # IronPython2
# ---------- python_script_2.python (8 lines) ----------
data = IN[0]

ss = []
for i in data:
	if i!="False": ss.append(True)
	else: ss.append(False)	

OUT = ss
# ----------------------------------------
filterByBoolMask = List.FilterByBoolMask(list=watch, mask=python_script_2)
isViewTemplate = View.IsViewTemplate(view=filterByBoolMask.out)
filterByBoolMask_2 = List.FilterByBoolMask(list=filterByBoolMask.out, mask=isViewTemplate)
watch_2 = Watch(filterByBoolMask_2.out)
delete = Element.Delete(element=watch_2)
string_from_object_2 = FromObject(object=watch_2)
input_check = Python(IN[0]=string_from_object_2)  # IronPython2
# ---------- input_check.python (8 lines) ----------
input = IN[0]
elements = []

if isinstance(input, list): 
	for i in input:	elements.append(i)
else: elements = [input]
		
OUT = elements
# ----------------------------------------
pop_up_message = Python(IN[0]=input_check)  # IronPython2
# ---------- pop_up_message.python (19 lines) ----------
#This script pops up a dialog box with a message from the previous node.
import clr
clr.AddReference('RevitAPIUI')

from Autodesk.Revit.UI import TaskDialog

ff = []
for i in IN[0]: ff.append(i + " \n")

mainText = "DELETED LIST: \n " + ''.join(i for i in ff)


if mainText != None and mainText != "null"  :
	messagePop = TaskDialog("Dynamo Player")
	messagePop.MainContent = mainText
	
	OUT = "Success!"
	
	messagePop.Show()
# ----------------------------------------
comparator_to_incl_str_str = Python(IN[0]=getParameterValueByName, IN[1]=code_block_3, IN[2]=null_check)  # "comparator to INCL (str,str,element)"; IronPython2
# ---------- comparator_to_incl_str_str.python (26 lines) ----------
x = IN[0]
y = IN[1]
z = IN[2]


#if you want to INCLUDE then swap jk.append(False) and jk.append(True)
jk = []
zf = []

for i in range(len(x)):
	for j in range(len(y)):
		if x[i].find(y[j])!=-1: 
			zf = True
	if zf == True:
		jk.append(True)
	else:
		jk.append(False)
	zf = []
	
ist = zip(z,jk)
kg = []
for i in ist:
	if i[1] ==True:
		kg.append(i[0])
	
OUT = kg
# ----------------------------------------
watch_3 = Watch(comparator_to_incl_str_str)
pop_up_message_2 = Python()  # IronPython2; unwired: IN[0]; same code as pop_up_message
