# Dynamo graph View_Open1.dyn (Dynamo 2.6.1.8786)

# note: Name in format A0.0
# note: Two scenarios selector
# note: Name in format A0
# note: Find title block

get_all_views = Python()  # unwired: IN[0]
# ---------- get_all_views.python (43 lines) ----------
#Copyright(c) 2019, Aaron Rumple, AIA

import clr
import System
clr.AddReference('ProtoGeometry')
from Autodesk.DesignScript.Geometry import *

# Import ToDSType(bool) extension method
clr.AddReference("RevitNodes")
import Revit
clr.ImportExtensions(Revit.Elements)

# Import DocumentManager and TransactionManager
clr.AddReference("RevitServices")
import RevitServices
from RevitServices.Persistence import DocumentManager
from RevitServices.Transactions import TransactionManager

#from System.Collections.Generic import *

# Import RevitAPI
clr.AddReference("RevitAPI")
import Autodesk
from Autodesk.Revit.DB import *

from Revit.Elements import *

doc = DocumentManager.Instance.CurrentDBDocument

def getViews(inViews):
	myViewsList = []
	for v in inViews:
		if v.IsTemplate:
			isTemplate = True
		else:
			isTemplate = False
		myViewsList.append(v.ToDSType(True))
	return myViewsList

allViews = FilteredElementCollector(doc).OfClass(View)
allViewsList = getViews(allViews)

OUT = allViewsList
# ----------------------------------------
string_from_object = FromObject(obj=get_all_views)
view_unique_word = StringInput("USER ATTENTION")  # graph input
contains = String.Contains(str=string_from_object, searchFor=view_unique_word)
filterByBoolMask = List.FilterByBoolMask(list=get_all_views, mask=contains)
string_from_object_2 = FromObject(obj=get_all_views)
view_unique_word_2 = StringInput("_DETAILS LIBRARY")  # graph input
contains_2 = String.Contains(str=string_from_object_2, searchFor=view_unique_word_2)
filterByBoolMask_2 = List.FilterByBoolMask(list=get_all_views, mask=contains_2)
python_script = Python(IN[0]=filterByBoolMask.in, IN[1]=filterByBoolMask_2.in)
# ---------- python_script.python (5 lines) ----------
if IN[1] == []:
	OUT = IN[0]
	
	
else: OUT = IN[1]
# ----------------------------------------
setIntersection = List.SetIntersection(list1=python_script, list2=get_all_views)
firstItem = List.FirstItem(list=setIntersection)
# note: any view
thomasmahon_epic_script = Python(IN[0]=firstItem)
# ---------- thomasmahon_epic_script.python (24 lines) ----------
#Copyright 2016. All rights reserved. Bimorph Consultancy LTD, 5 St Johns Lane, London EC1M 4BH www.bimorph.co.uk
#Written by Thomas Mahon @Thomas__Mahon info@bimorph.co.uk Package: bimorphNodes
#GitHub: https://github.com/ThomasMahon/bimorphNodes/
#Follow: facebook.com/bimorphBIM | linkedin.com/company/bimorph-bim | @bimorphBIM

import clr

clr.AddReference("RevitServices")
import RevitServices
from RevitServices.Persistence import DocumentManager
from RevitServices.Transactions import TransactionManager

clr.AddReference("RevitAPI")
import Autodesk
from Autodesk.Revit.DB import *

doc = DocumentManager.Instance.CurrentDBDocument
uidoc = DocumentManager.Instance.CurrentUIDocument

TransactionManager.Instance.EnsureInTransaction(doc)
TransactionManager.Instance.ForceCloseTransaction()

view = UnwrapElement(IN[0])
uidoc.RequestViewChange( view )
# ----------------------------------------
