# Dynamo graph View_last_on_Sheet.dyn (Dynamo 2.10.1.3976)

current = Document.Current()
activeView = Document.ActiveView(document=current)
string_from_object = FromObject(object=activeView)
code_block = CodeBlock { "Sheet(Name = "; }
contains = String.Contains(str=string_from_object, searchFor=code_block)
string = StringInput("Sheet Number")
getParameterValueByName = Element.GetParameterValueByName(element=activeView, parameterName=string)

# group: check if a user in a view not in a Sheet --> get the Sheet
code_block_2 = CodeBlock { "Sheets"; }
byName = Category.ByName(name=code_block_2)
all_elements_of_category = ElementsOfCategory(Category=byName)

sheetNumber = Sheet.SheetNumber(sheet=all_elements_of_category)

# group (continued): check if a user in a view not in a Sheet --> get the Sheet
contains_2 = String.Contains(str=sheetNumber, searchFor=getParameterValueByName, lacing=Longest)
flatten = List.Flatten(list=contains_2)
filterByBoolMask = List.FilterByBoolMask(list=all_elements_of_category, mask=flatten)

if_ = If(test=contains, true=activeView, false=filterByBoolMask.in)
code_block_3 = CodeBlock(X=if_) { X[0]; }
code_block_4 = CodeBlock { "Views"; }
byName_2 = Category.ByName(name=code_block_4)
all_elements_of_category_2 = ElementsOfCategory(Category=byName_2)
input_check = Python(IN[0]=all_elements_of_category_2)  # IronPython2
# ---------- input_check.python (8 lines) ----------
input = IN[0]
elements = []

if isinstance(input, list): 
	for i in input:	elements.append(i)
else: elements = [input]
		
OUT = elements
# ----------------------------------------
string_from_object_2 = FromObject(obj=input_check)
null_check = Python(IN[0]=string_from_object_2, IN[1]=input_check)  # IronPython2
# ---------- null_check.python (12 lines) ----------
strings = IN[0]
list = IN[1]

elements = []


for a,b in zip(strings, list):	
	if a != "null":
		elements.append(b)

		
OUT = elements
# ----------------------------------------
template_check = Python(IN[0]=null_check)  # IronPython2
# ---------- template_check.python (12 lines) ----------
# Load the Python Standard and DesignScript Libraries
#import sys
#import clr
#clr.AddReference("RevitAPI")


xz = []
for i in IN[0]:
	if UnwrapElement(i).IsTemplate==False:
		xz.append(i)

OUT =xz 
# ----------------------------------------
get_last_not_on_sheet = Python(IN[0]=template_check)  # IronPython2
# ---------- get_last_not_on_sheet.python (29 lines) ----------
# Load the Python Standard and DesignScript Libraries
import sys
import clr
clr.AddReference("RevitAPI")
from Autodesk.Revit.DB import *

xz = []
for i in IN[0]:
	xz.append(UnwrapElement(i))

def func(list, i):
	dg = []
	ff = list[len(list)-i]	
	fg =ff.GetParameters("Sheet Name")
	if not fg: #check if exists
		return ff
	else:
		return list[:-1]

mm = func(xz,1)

zx = []

while type(mm) is list and len(mm)>1:	
	#param = param+1
	mm = func(mm,1)
	#zx.append("+1")

OUT = mm
# ----------------------------------------
watch = Watch(get_last_not_on_sheet)

# group: X offset
outline = View.Outline(view=watch)
maxPoint = BoundingBox.MaxPoint(boundingBox=outline)
minPoint = BoundingBox.MinPoint(boundingBox=outline)
x_size_2 = Python(IN[0]=maxPoint, IN[1]=minPoint)  # IronPython2
# ---------- x_size_2.python (12 lines) ----------
# Load the Python Standard and DesignScript Libraries
import sys
import clr
clr.AddReference('ProtoGeometry')
from Autodesk.DesignScript.Geometry import *

a = IN[0]
b = IN[1]


	
OUT = (a.X-b.X)*304/2
# ----------------------------------------

# group: offset
viewports = Sheet.Viewports(sheet=code_block_3)
boxOutline = Viewport.BoxOutline(viewport=viewports)
maxPoint_2 = BoundingBox.MaxPoint(boundingBox=boxOutline)
active_view_central_point = Python()  # IronPython2; unwired: IN[0]
# ---------- active_view_central_point.python (51 lines) ----------
import sys
import clr

clr.AddReference("RevitServices")
import RevitServices
from RevitServices.Persistence import DocumentManager
from RevitServices.Transactions import TransactionManager


clr.AddReference('RevitAPI')
from Autodesk.Revit.DB import *
from Autodesk.Revit.DB import Transaction

clr.AddReference('ProtoGeometry')
from Autodesk.DesignScript.Geometry import *

doc = DocumentManager.Instance.CurrentDBDocument
uidoc=DocumentManager.Instance.CurrentUIApplication.ActiveUIDocument


x = uidoc.GetOpenUIViews()
z = []
for i in x: z.append(i.ViewId)
h = doc.ActiveView.Id
zzz = []

ff = 231



test = []
for i in z:
	if h == i: test.append("True")
	else: test.append("False")

for i in x:
	test.append(i.GetZoomCorners())

zz = zip(z,test,x)

res = []
for i in range(0,len(zz)):
	if zz[i][1] == "True": res.append(zz[i][2])
	

z = res[0].GetZoomCorners()

point = (z[0][0]+z[1][0])/2, (z[0][1]+z[1][1])/2


OUT = Point.ByCoordinates(point[0]*304,point[1]*304,0)
# ----------------------------------------
minPoint_2 = BoundingBox.MinPoint(boundingBox=boxOutline)
boxCenter = Viewport.BoxCenter(viewport=viewports)
run_multiple_view_scenario = Python(IN[0]=code_block_3, IN[1]=maxPoint_2, IN[2]=active_view_central_point, IN[3]=minPoint_2, IN[4]=boxCenter, IN[5]=x_size_2)  # IronPython2
# ---------- run_multiple_view_scenario.python (35 lines) ----------
import clr

clr.AddReference("RevitServices")
import RevitServices
from RevitServices.Persistence import DocumentManager
from RevitServices.Transactions import TransactionManager
doc =  DocumentManager.Instance.CurrentDBDocument
app = DocumentManager.Instance.CurrentUIApplication.Application

clr.AddReference("RevitAPI")
from Autodesk.Revit.DB import *


clr.AddReference('ProtoGeometry')
from Autodesk.DesignScript.Geometry import *

bboxpoint = IN[1]
cpoint = IN[2]
bboxmin = IN[3]
bbcenter =IN[4]
shift = IN[5]

if len(bboxpoint)>0:
	xmax = []
	for i in bboxpoint:
		xmax.append(i.X)
	maxv = max(xmax)
	indx = xmax.index(maxv)
	shifted_p = Point.ByCoordinates(bboxpoint[indx].X+1.2*shift,bbcenter[indx].Y, 0)
	newp = "existing view detected", shifted_p
	
else:
	newp = "no view detected", cpoint
		
OUT = newp
# ----------------------------------------

place_views_on_sheet_py = Python(IN[0]=code_block_3, IN[1]=watch, IN[2]=run_multiple_view_scenario)  # IronPython2
# ---------- place_views_on_sheet_py.python (33 lines) ----------
################### Import References ###################
import clr

clr.AddReference("RevitServices")
import RevitServices
from RevitServices.Persistence import DocumentManager
from RevitServices.Transactions import TransactionManager
doc =  DocumentManager.Instance.CurrentDBDocument
app = DocumentManager.Instance.CurrentUIApplication.Application

clr.AddReference("RevitNodes")
import Revit
clr.ImportExtensions(Revit.Elements)
clr.ImportExtensions(Revit.GeometryConversion)

clr.AddReference("RevitAPI")
from Autodesk.Revit.DB import *
################### Definitions ###################


################### Outputs ###################
sht = UnwrapElement(IN[0])
v = UnwrapElement(IN[1])
l = UnwrapElement(IN[2][1])
################### Script ###################



TransactionManager.Instance.EnsureInTransaction(doc)
vp = Viewport.Create(doc,sht.Id,v.Id,l.ToXyz())
	
	
OUT = [vp]
# ----------------------------------------

# group: viewport type
lastItem = List.LastItem(list=viewports)
find_type = Python(IN[0]=lastItem)  # IronPython2
# ---------- find_type.python (37 lines) ----------
# Load the Python Standard and DesignScript Libraries
import sys
import clr
import errno
import os
clr.AddReference('ProtoGeometry')
from Autodesk.DesignScript.Geometry import *
clr.AddReference("RevitServices")
import RevitServices
from RevitServices.Persistence import DocumentManager
from RevitServices.Transactions import TransactionManager


clr.AddReference('RevitAPI')
from Autodesk.Revit.DB import *
from Autodesk.Revit.DB import Transaction

doc = DocumentManager.Instance.CurrentDBDocument
uidoc=DocumentManager.Instance.CurrentUIApplication.ActiveUIDocument

# The inputs to this node will be stored as a list in the IN variables.
try:
	input = IN[0]
	elements = []
	
	if isinstance(input, list): 
		for i in input:	elements.append(i)
	else: elements = [input]
	
	z = []
	for i in elements:
		z.append(UnwrapElement(i).GetTypeId())
		
	OUT = z
#GetParameter("Detail Number")
except:
	OUT = "can't find"
# ----------------------------------------
setviewporttype_viewport_id = Python(IN[0]=place_views_on_sheet_py, IN[1]=find_type)  # IronPython2
# ---------- setviewporttype_viewport_id.python (45 lines) ----------
import clr
# Import Element wrapper extension methods
clr.AddReference("RevitNodes")
import Revit
clr.ImportExtensions(Revit.Elements)

# Import DocumentManager and TransactionManager
clr.AddReference("RevitServices")
import RevitServices
from RevitServices.Persistence import DocumentManager
from RevitServices.Transactions import TransactionManager
doc = DocumentManager.Instance.CurrentDBDocument

import sys

# Import RevitAPI
clr.AddReference("RevitAPI")
import Autodesk
from Autodesk.Revit.DB import *

#The inputs to this node will be stored as a list in the IN variable.

viewPort=IN[0]
newId=IN[1]

elements = []
if isinstance(viewPort, list): 
	for i in viewPort:	elements.append(i)
else: elements = [viewPort]

ids = []
if isinstance(newId, list): 
	for i in newId:	ids.append(i)
else: ids = [newId]


TransactionManager.Instance.EnsureInTransaction(doc)

for i in range(len(elements)):
	UnwrapElement(elements[i]).ChangeTypeId(newId[i])
	
TransactionManager.Instance.TransactionTaskDone()

#Assign your output to the OUT variable
OUT = newId
# ----------------------------------------

view = Viewport.View(viewport=viewports)
lastItem_2 = List.LastItem(list=view)
scale = View.Scale(view=get_last_not_on_sheet)
scale_2 = View.Scale(view=view)
COMPARE = Python(IN[0]=scale, IN[1]=scale_2)  # IronPython2
# ---------- COMPARE.python (13 lines) ----------
a = IN[0]
b = IN[1]

res = 0

if a==b:
	res = 1
elif a>b:
	res = 2
elif b>a:
	res = 3

OUT = res
# ----------------------------------------
