# Dynamo graph View_x_Filter_Create.dyn (Dynamo 2.10.1.3976)

working_filter_example = Python()  # IronPython2; unwired: IN[0]
# ---------- working_filter_example.python (54 lines) ----------
import clr

clr.AddReference("RevitServices")
import RevitServices
from RevitServices.Persistence import DocumentManager
from RevitServices.Transactions import TransactionManager

clr.AddReference("RevitAPI")
import Autodesk
from Autodesk.Revit.DB import *
import System
from System.Collections.Generic import *
from System.Collections.Generic import List

doc=DocumentManager.Instance.CurrentDBDocument
app=DocumentManager.Instance.CurrentUIApplication.Application
#First construct an ICollection of StructuralFraming and Structural Column Categories:
if IN[0] == True:
	beamcolumncatlist=[]
	beamcolumncatlist.Add(ElementId(BuiltInCategory.OST_StructuralFraming))
	beamcolumncatlist.Add(ElementId(BuiltInCategory.OST_StructuralColumns))
	iCollBeamColumnCats=List[ElementId](beamcolumncatlist)
	#Next get the parameters you will be testing on (in this case the Comments parameter and the Family Name):
	
	pComment=ParameterValueProvider(ElementId(BuiltInParameter.ALL_MODEL_INSTANCE_COMMENTS))
	pFamName=ParameterValueProvider(ElementId(BuiltInParameter.ALL_MODEL_FAMILY_NAME))
	#Next construct the Filter Rules/Tests on those parameters:
	
	xFamName=FilterStringRule(pFamName,FilterStringBeginsWith(),"Blue",False)
	xCommSteel=FilterStringRule(pComment,FilterStringEquals(),"Steel",False)
	xCommMagnum=FilterStringRule(pComment,FilterStringEquals(),"Magnum",False)
	#Now construct the actual filter (ParameterFilterElement) - note that this must occur inside a transaction:
	
	TransactionManager.Instance.EnsureInTransaction(doc)
	##Make an ICollection of the “Blue” and “Steel” filter tests, then use that ICollection to construct an AND filter set.
	
	beamcolumnfilt1=[]
	beamcolumnfilt1.Add(ElementParameterFilter(xFamName))
	beamcolumnfilt1.Add(ElementParameterFilter(xCommSteel))
	icolbeamcolumnfilt1=List[ElementFilter](beamcolumnfilt1)
	andbeamcolumnfilt1=LogicalAndFilter(icolbeamcolumnfilt1)
	##Now make an ICollection of the “Magnum” tests and the previous AND of “Blue”+“Steel”, then use that ICollection to construct an OR filter set.
	
	beamcolumnfilt2=[]
	beamcolumnfilt2.Add(ElementParameterFilter(xCommMagnum))
	beamcolumnfilt2.Add(andbeamcolumnfilt1)
	icolbeamcolumnfilt2=List[ElementFilter](beamcolumnfilt2)
	orbeamcolumnfilt2=LogicalOrFilter(icolbeamcolumnfilt2)
	##Now construct a ParameterFilterElement called “ZoolanderBeamsColumns” using the previously defined beam and column category ICollection and the OR ElementParameterFilter.
	
	pfebeamcolelem=ParameterFilterElement.Create(doc,"ZoolanderBeamsColumns",iCollBeamColumnCats,orbeamcolumnfilt2)
	TransactionManager.Instance.TransactionTaskDone()
	
else: OUT = "add TRUE to IN[0] for RUN"
# ----------------------------------------
code_block = CodeBlock { "StructuralColumns"; }
code_block_2 = CodeBlock { "StructuralFraming"; }
code_block_3 = CodeBlock { "view to make filter"; }
code_block_4 = CodeBlock { "creates filter View typename_EXCEPT based on View TYPE"; }
code_block_5 = CodeBlock { "Sections"; }
code_block_6 = CodeBlock { "Callouts"; }
list_create = List.Create(item0=code_block_5, item1=code_block_6)
get_the_names = Python(IN[0]=list_create)  # IronPython2
# ---------- get_the_names.python (22 lines) ----------
# by Alexander Berg | 2020-03-07 | Automated Design Solutions

import clr, System
clr.AddReference('RevitAPI')
import Autodesk
from Autodesk.Revit.DB import *

x = IN[0]

def get_the_name(f):
# by Alexander Berg | 2020-03-07 | Automated Design Solutions
	z = [i for i in System.Enum.GetValues(BuiltInCategory) if str(i) == "OST_"+f]
	return z[0]


s = []
for i in x:
	s.append(get_the_name(i))



OUT = s
# ----------------------------------------
select_model_element = DSModelElementSelection()  # 1 picked in the model; graph input
views = Python(IN[0]=select_model_element)  # IronPython2
# ---------- views.python (23 lines) ----------
import clr
clr.AddReference('RevitAPI')
from Autodesk.Revit.DB import *


x = UnwrapElement (IN[0])

try:
	if type(IN[0]) is list:
		views = []
		for i in x:	views.append(i.ViewId)	
	else:
		views = x.ViewId

except:
	if type(IN[0]) is list:
		views = []
		for i in x:	views.append(i.Id)	
	else:
		views = x.Id


OUT = views
# ----------------------------------------
element_by_id = ElementById(Id=views)
get_name = Python(IN[0]=element_by_id)  # IronPython2
# ---------- get_name.python (13 lines) ----------
#Import Revit API
import clr
clr.AddReference('RevitAPI')
import Autodesk
from Autodesk.Revit.DB import *


x = IN[0]
y = UnwrapElement(x)

views = y.get_Parameter(BuiltInParameter.VIEW_TYPE).AsString()

OUT = views
# ----------------------------------------
name = Python(IN[0]=get_name)  # IronPython2
# ---------- name.python (8 lines) ----------
x = IN[0].split("(",1)
y = x.pop(0)
z = ''.join(x)

a = z.rsplit(")",1)
c = ''.join(a)

OUT =c
# ----------------------------------------
generate = Python(IN[0]=name)  # IronPython2
# ---------- generate.python (1 lines) ----------
OUT = "Sections_"+IN[0]+"_Except"
# ----------------------------------------
watch = Watch(generate)
code_block_7 = CodeBlock(x=name) { "("+x+")"; }
for_2_filters_atm_need_only_1 = List.Create(item0=code_block_7, item1=get_name)
string = StringInput("VIEW_TYPE")
boolean = BoolSelector(true)
python_script = Python(IN[0]=get_the_names, IN[1]=watch, IN[2]=for_2_filters_atm_need_only_1, IN[3]=string, IN[4]=boolean)  # IronPython2
# ---------- python_script.python (58 lines) ----------
import clr

clr.AddReference("RevitServices")
import RevitServices
from RevitServices.Persistence import DocumentManager
from RevitServices.Transactions import TransactionManager

clr.AddReference("RevitAPI")
import Autodesk
from Autodesk.Revit.DB import *
import System
from System.Collections.Generic import *
from System.Collections.Generic import List

doc=DocumentManager.Instance.CurrentDBDocument
app=DocumentManager.Instance.CurrentUIApplication.Application
#First construct an ICollection of StructuralFraming and Structural Column Categories:

beamcolumncatlist=[]
for i in IN[0]:
	beamcolumncatlist.append(ElementId(i))
iCollBeamColumnCats=List[ElementId](beamcolumncatlist)
#Next get the parameters you will be testing on (in this case the Comments parameter and the Family Name):


pFamName=ParameterValueProvider(ElementId(getattr(BuiltInParameter,IN[3])))
#Next construct the Filter Rules/Tests on those parameters:

xFamName1=FilterInverseRule(FilterStringRule(pFamName,FilterStringContains(),IN[2][0],False))
#xFamName2=FilterInverseRule(FilterStringRule(pFamName,FilterStringContains(),IN[2][1],False))

#Now construct the actual filter (ParameterFilterElement) - note that this must occur inside a transaction:

TransactionManager.Instance.EnsureInTransaction(doc)
##Make an ICollection of the “Blue” and “Steel” filter tests, then use that ICollection to construct an AND filter set.

beamcolumnfilt1=[]
beamcolumnfilt1.Add(ElementParameterFilter(xFamName1))
#beamcolumnfilt1.Add(ElementParameterFilter(xFamName2))


icolbeamcolumnfilt1=List[ElementFilter](beamcolumnfilt1)
andbeamcolumnfilt1=LogicalOrFilter(icolbeamcolumnfilt1)
##Now make an ICollection of the “Magnum” tests and the previous AND of “Blue”+“Steel”, then use that ICollection to construct an OR filter set.


##Now construct a ParameterFilterElement called “ZoolanderBeamsColumns” using the previously defined beam and column category ICollection and the OR ElementParameterFilter.
try:
	if IN[4] == True:
		pfebeamcolelem=ParameterFilterElement.Create(doc,IN[1],iCollBeamColumnCats,andbeamcolumnfilt1)
		TransactionManager.Instance.TransactionTaskDone()
		OUT = "Filter " + IN[1] +  " has been successfully created"
	else: OUT = "feed TRUE to IN[4]"
	
except: 

	OUT = "Filter " + IN[1] +  " already exists"
	
# ----------------------------------------
watch_2 = Watch(python_script)
pop_up_message = Python(IN[0]=watch_2)  # IronPython2
# ---------- pop_up_message.python (23 lines) ----------
#This script pops up a dialog box with a message from the previous node.
import clr
clr.AddReference('RevitAPIUI')

from Autodesk.Revit.UI import TaskDialog


mainText = IN[0]

if mainText != None and mainText != "null"  :
	messagePop = TaskDialog("Dynamo Player")
	messagePop.MainContent = mainText
	
	OUT = "Success!"
	
	messagePop.Show()
else:
	messagePop = TaskDialog("Dynamo Player")
	messagePop.MainContent = "Select proper type (section or viewport)"
	
	OUT = "Success!"
	
	messagePop.Show()	
# ----------------------------------------
