# Dynamo graph Viewport_MOVE.dyn (Dynamo 2.5.0.7460)

select_model_elements = DSModelElementsSelection()  # 1 picked in the model
string_from_object = FromObject(obj=select_model_elements)
code_block = CodeBlock { "Viewport"; }
contains = List.Contains(list=string_from_object, item=code_block, lacing=Longest)
filterByBoolMask = List.FilterByBoolMask(list=select_model_elements, mask=contains)
views = Python(IN[0]=filterByBoolMask.in)
# ---------- views.python (25 lines) ----------
# Load the Python Standard and DesignScript Libraries

import clr
clr.AddReference("RevitServices")
import RevitServices
from RevitServices.Persistence import DocumentManager

doc = DocumentManager.Instance.CurrentDBDocument

try:
	viewp = IN[0]
	
	#get the views from viewports
	views = []
	if isinstance(viewp, list): 
		for i in viewp:
			views.append(doc.GetElement(UnwrapElement(i).ViewId))
	else: views.append(doc.GetElement(UnwrapElement(viewp).ViewId))
	
	
	OUT = views

#GetParameter("Detail Number")
except:
	OUT = "123"
# ----------------------------------------
watch = Watch(select_model_elements)
find_type = Python(IN[0]=watch)
# ---------- find_type.python (37 lines) ----------
# Load the Python Standard and DesignScript Libraries
import sys
import clr
import errno
import os
clr.AddReference('ProtoGeometry')
from Autodesk.DesignScript.Geometry import *
clr.AddReference("RevitServices")
import RevitServices
from RevitServices.Persistence import DocumentManager
from RevitServices.Transactions import TransactionManager


clr.AddReference('RevitAPI')
from Autodesk.Revit.DB import *
from Autodesk.Revit.DB import Transaction

doc = DocumentManager.Instance.CurrentDBDocument
uidoc=DocumentManager.Instance.CurrentUIApplication.ActiveUIDocument

# The inputs to this node will be stored as a list in the IN variables.
try:
	input = IN[0]
	elements = []
	
	if isinstance(input, list): 
		for i in input:	elements.append(i)
	else: elements = [input]
	
	z = []
	for i in elements:
		z.append(UnwrapElement(i).GetTypeId())
		
	OUT = z	
#GetParameter("Detail Number")
except:
	OUT = "123"
# ----------------------------------------
delete = Python(IN[0]=filterByBoolMask.in, IN[1]=find_type, IN[2]=views)
# ---------- delete.python (51 lines) ----------
# Load the Python Standard and DesignScript Libraries
import sys
import clr
clr.AddReference('ProtoGeometry')
from Autodesk.DesignScript.Geometry import *
clr.AddReference("RevitServices")
import RevitServices
from RevitServices.Persistence import DocumentManager
from RevitServices.Transactions import TransactionManager


clr.AddReference('RevitAPI')
from Autodesk.Revit.DB import *
from Autodesk.Revit.DB import Transaction

doc = DocumentManager.Instance.CurrentDBDocument
uidoc=DocumentManager.Instance.CurrentUIApplication.ActiveUIDocument


if IN[1]!="123" and IN[2]!="123":
	viewp = []
	if isinstance(IN[0], list): 
		for i in IN[0]: viewp.append(UnwrapElement(i))
	else: viewp = UnwrapElement(IN[0])
	
	
	TransactionManager.Instance.EnsureInTransaction(doc)
	#get sheet id of viewports
	if isinstance(viewp, list): sheet_from = doc.GetElement(viewp[0].SheetId)
	else: sheet_from = doc.GetElement(viewp.SheetId)
	
	#get the views from viewports
	views = []
	if isinstance(viewp, list): 
		for i in viewp:
			views.append(doc.GetElement(i.OwnerViewId))
	else: views.append(doc.GetElement(viewp.OwnerViewId))
	
	
	#delete viewports
	if isinstance(viewp, list):
		for i in viewp:
			sheet_from.DeleteViewport(i)
	else: sheet_from.DeleteViewport(viewp)
	
	
	TransactionManager.Instance.TransactionTaskDone()
	
	
	
	OUT = views
# ----------------------------------------
passthrough = Python(IN[0]=views, IN[1]=delete)
# ---------- passthrough.python (7 lines) ----------
d = IN[0]
p = IN[1]

if p is not None: out = d
else: out = "wait"

OUT = out
# ----------------------------------------
watch_2 = Watch(passthrough)
coordinates = Python(IN[0]=filterByBoolMask.in)
# ---------- coordinates.python (42 lines) ----------
#Copyright (c) mostafa el ayoubi ,  2019 , @data_shapes
#Data-Shapes www.data-shapes.io , mostafa.elayoubi@data-shapes.io
import clr
clr.AddReference('RevitAPI')
from Autodesk.Revit.DB import *
clr.AddReference('ProtoGeometry')
from Autodesk.DesignScript.Geometry import Point as dspt
clr.AddReference('RevitServices')
from RevitServices.Persistence import DocumentManager
doc = DocumentManager.Instance.CurrentDBDocument
output = []

clr.AddReference('RevitNodes')
import Revit
clr.ImportExtensions(Revit.GeometryConversion)

from RevitServices.Transactions import TransactionManager
TransactionManager.Instance.ForceCloseTransaction


def toList(input):
	if isinstance(input,list):
		return UnwrapElement(input)
	else:
		return [UnwrapElement(input)]

locs = []

try:
	vps = toList(IN[0])
	
	for v in vps:
		try:
			locs.append(v.GetBoxCenter().ToPoint())
		except:
			locs.append(v.Point.ToPoint())
			
	
	OUT = locs
#GetParameter("Detail Number")
except:
	OUT = "123"	
# ----------------------------------------
watch_3 = Watch(coordinates)
create_viewport = Python(IN[0]=watch_2, IN[1]=watch_3)
# ---------- create_viewport.python (32 lines) ----------
# Load the Python Standard and DesignScript Libraries
import sys
import clr
clr.AddReference('ProtoGeometry')
from Autodesk.DesignScript.Geometry import *
clr.AddReference("RevitServices")
import RevitServices
from RevitServices.Persistence import DocumentManager
from RevitServices.Transactions import TransactionManager


clr.AddReference('RevitAPI')
from Autodesk.Revit.DB import *
from Autodesk.Revit.DB import Transaction

doc = DocumentManager.Instance.CurrentDBDocument
uidoc=DocumentManager.Instance.CurrentUIApplication.ActiveUIDocument


sheet_to = doc.ActiveView

points = IN[1]

#get the views from viewports
views = UnwrapElement(IN[0])

for i in range(0,len(views)):
	Viewport.Create(doc, sheet_to.Id, views[i].Id, XYZ(points[i].X/304.8, points[i].Y/304.8, points[i].Z/304.8))

collector = FilteredElementCollector(doc).OfClass(Viewport).ToElements()

OUT = collector[-len(views):]
# ----------------------------------------
watch_4 = Watch(create_viewport)
code_block_2 = CodeBlock { "Detail Number"; }
find_detail_name = Python(IN[0]=watch)
# ---------- find_detail_name.python (39 lines) ----------
# Load the Python Standard and DesignScript Libraries
import sys
import clr
clr.AddReference('ProtoGeometry')
from Autodesk.DesignScript.Geometry import *
clr.AddReference("RevitServices")
import RevitServices
from RevitServices.Persistence import DocumentManager
from RevitServices.Transactions import TransactionManager


clr.AddReference('RevitAPI')
from Autodesk.Revit.DB import *
from Autodesk.Revit.DB import Transaction

doc = DocumentManager.Instance.CurrentDBDocument
uidoc=DocumentManager.Instance.CurrentUIApplication.ActiveUIDocument

# The inputs to this node will be stored as a list in the IN variables.
try:

	input = IN[0]
	elements = []
	
	if isinstance(input, list): 
		for i in input:	elements.append(i)
	else: elements = [input]
	
	z = []
	for i in elements:
		z.append(doc.GetElement(UnwrapElement(i).ViewId).get_Parameter(BuiltInParameter.VIEWPORT_DETAIL_NUMBER).AsString())
	#GetParameter("Detail Number")
	
	
	
	OUT = z

except:
	OUT = "123"
# ----------------------------------------
watch_5 = Watch(find_detail_name)
check_for_same_names = Python()  # unwired: IN[0]
# ---------- check_for_same_names.python (28 lines) ----------
# Load the Python Standard and DesignScript Libraries
import sys
import clr
clr.AddReference('ProtoGeometry')
from Autodesk.DesignScript.Geometry import *
clr.AddReference("RevitServices")
import RevitServices
from RevitServices.Persistence import DocumentManager
from RevitServices.Transactions import TransactionManager


clr.AddReference('RevitAPI')
from Autodesk.Revit.DB import *
from Autodesk.Revit.DB import Transaction

doc = DocumentManager.Instance.CurrentDBDocument
uidoc=DocumentManager.Instance.CurrentUIApplication.ActiveUIDocument

# The inputs to this node will be stored as a list in the IN variables.


elems = FilteredElementCollector(doc, doc.ActiveView.Id).OfClass(Viewport).WhereElementIsNotElementType().ToElements()

z = []
for i in elems:
	z.append(doc.GetElement(UnwrapElement(i).ViewId).get_Parameter(BuiltInParameter.VIEWPORT_DETAIL_NUMBER).AsString())

OUT = z
# ----------------------------------------
watch_6 = Watch(check_for_same_names)
check_for_same_names_2 = Python(IN[0]=watch_5, IN[1]=watch_6)
# ---------- check_for_same_names_2.python (11 lines) ----------
x = IN[0]
y = IN[1]

m = ', '
f = []
for i in range(len(x)):
	if x[i] in y: f.append(x[i]+"'")
	else: f.append(x[i])


OUT = f
# ----------------------------------------
watch_7 = Watch(check_for_same_names_2)
setParameterByName = Element.SetParameterByName(element=watch_4, parameterName=code_block_2, value=watch_7)
watch_8 = Watch(find_type)
setviewporttype_viewport_id = Python(IN[0]=watch_4, IN[1]=watch_8)
# ---------- setviewporttype_viewport_id.python (45 lines) ----------
import clr
# Import Element wrapper extension methods
clr.AddReference("RevitNodes")
import Revit
clr.ImportExtensions(Revit.Elements)

# Import DocumentManager and TransactionManager
clr.AddReference("RevitServices")
import RevitServices
from RevitServices.Persistence import DocumentManager
from RevitServices.Transactions import TransactionManager
doc = DocumentManager.Instance.CurrentDBDocument

import sys

# Import RevitAPI
clr.AddReference("RevitAPI")
import Autodesk
from Autodesk.Revit.DB import *

#The inputs to this node will be stored as a list in the IN variable.

viewPort=IN[0]
newId=IN[1]

elements = []
if isinstance(viewPort, list): 
	for i in viewPort:	elements.append(i)
else: elements = [viewPort]

ids = []
if isinstance(newId, list): 
	for i in newId:	ids.append(i)
else: ids = [newId]


TransactionManager.Instance.EnsureInTransaction(doc)

for i in range(len(elements)):
	UnwrapElement(elements[i]).ChangeTypeId(newId[i])
	
TransactionManager.Instance.TransactionTaskDone()

#Assign your output to the OUT variable
OUT = newId
# ----------------------------------------
