# Dynamo graph 0_TEMPLATE.dyn (Dynamo 2.10.1.3976)

current = Document.Current()
activeView = Document.ActiveView(document=current)
views = Views("3D RC Walls only")
place_viewport = Python(IN[0]=activeView, IN[1]=views)  # IronPython2
# ---------- place_viewport.python (35 lines) ----------
# Load the Python Standard and DesignScript Libraries
import sys
import clr
clr.AddReference('ProtoGeometry')
from Autodesk.DesignScript.Geometry import *
clr.AddReference("RevitServices")
import RevitServices
from RevitServices.Persistence import DocumentManager
from RevitServices.Transactions import TransactionManager

clr.AddReference('RevitAPI')
from Autodesk.Revit.DB import *

doc = DocumentManager.Instance.CurrentDBDocument
uidoc=DocumentManager.Instance.CurrentUIApplication.ActiveUIDocument


sheet_to = UnwrapElement(IN[0])



TransactionManager.Instance.EnsureInTransaction(doc)





sheet_to_id = doc.GetElement(sheet_to.Id)

Viewport.Create(doc, sheet_to.Id, UnwrapElement(IN[1]).Id, XYZ(0,0,0))

TransactionManager.Instance.TransactionTaskDone()


OUT = 0
# ----------------------------------------
active_view_central_point = Python()  # IronPython2; unwired: IN[0]
# ---------- active_view_central_point.python (49 lines) ----------
import sys
import clr
clr.AddReference('ProtoGeometry')
from Autodesk.DesignScript.Geometry import *
clr.AddReference("RevitServices")
import RevitServices
from RevitServices.Persistence import DocumentManager
from RevitServices.Transactions import TransactionManager


clr.AddReference('RevitAPI')
from Autodesk.Revit.DB import *
from Autodesk.Revit.DB import Transaction

doc = DocumentManager.Instance.CurrentDBDocument
uidoc=DocumentManager.Instance.CurrentUIApplication.ActiveUIDocument


x = uidoc.GetOpenUIViews()
z = []
for i in x: z.append(i.ViewId)
h = doc.ActiveView.Id


ff = 231



test = []
for i in z:
	if h == i: test.append("True")
	else: test.append("False")

for i in x:
	test.append(i.GetZoomCorners())

zz = zip(z,test,x)

res = []
for i in range(0,len(zz)):
	if zz[i][1] == "True": res.append(zz[i][2])
	

z = res[0].GetZoomCorners()

point = (z[0][0]+z[1][0])/2, (z[0][1]+z[1][1]/2)


OUT = z
# ----------------------------------------
firstItem = List.FirstItem(list=active_view_central_point)
lastItem = List.LastItem(list=active_view_central_point)
center_view_input_in_ft = Python(IN[0]=firstItem, IN[1]=lastItem)  # IronPython2
# ---------- center_view_input_in_ft.python (51 lines) ----------
import sys
import clr
clr.AddReference('ProtoGeometry')
from Autodesk.DesignScript.Geometry import *
clr.AddReference("RevitServices")
import RevitServices
from RevitServices.Persistence import DocumentManager
from RevitServices.Transactions import TransactionManager


clr.AddReference('RevitAPI')
from Autodesk.Revit.DB import *
from Autodesk.Revit.DB import Transaction

doc = DocumentManager.Instance.CurrentDBDocument
uidoc=DocumentManager.Instance.CurrentUIApplication.ActiveUIDocument


x = uidoc.GetOpenUIViews()
z = []
for i in x: z.append(i.ViewId)
h = doc.ActiveView.Id


ff = 2311



test = []
for i in z:
	if h == i: test.append("True")
	else: test.append("False")

for i in x:
	test.append(i.GetZoomCorners())

zz = zip(z,test,x)

res = []
for i in range(0,len(zz)):
	if zz[i][1] == "True": res.append(zz[i][2])
	

z = res[0].GetZoomCorners()

point = (z[0][0]+z[1][0])/2, (z[0][1]+z[1][1]/2)

res[0].ZoomAndCenterRectangle(XYZ(IN[0].X,IN[0].Y,IN[0].Z),XYZ(IN[1].X,IN[1].Y,IN[1].Z))


OUT = point
# ----------------------------------------
center_view_input_in_mm = Python()  # IronPython2; unwired: IN[0], IN[1]
# ---------- center_view_input_in_mm.python (51 lines) ----------
import sys
import clr
clr.AddReference('ProtoGeometry')
from Autodesk.DesignScript.Geometry import *
clr.AddReference("RevitServices")
import RevitServices
from RevitServices.Persistence import DocumentManager
from RevitServices.Transactions import TransactionManager


clr.AddReference('RevitAPI')
from Autodesk.Revit.DB import *
from Autodesk.Revit.DB import Transaction

doc = DocumentManager.Instance.CurrentDBDocument
uidoc=DocumentManager.Instance.CurrentUIApplication.ActiveUIDocument


x = uidoc.GetOpenUIViews()
z = []
for i in x: z.append(i.ViewId)
h = doc.ActiveView.Id


ff = 2311



test = []
for i in z:
	if h == i: test.append("True")
	else: test.append("False")

for i in x:
	test.append(i.GetZoomCorners())

zz = zip(z,test,x)

res = []
for i in range(0,len(zz)):
	if zz[i][1] == "True": res.append(zz[i][2])
	

z = res[0].GetZoomCorners()

point = (z[0][0]+z[1][0])/2, (z[0][1]+z[1][1]/2)

res[0].ZoomAndCenterRectangle(XYZ(IN[0].X/304.8,IN[0].Y/304.8,IN[0].Z),XYZ(IN[1].X/304.8,IN[1].Y/304.8,IN[1].Z))


OUT = point
# ----------------------------------------
input_check = Python()  # IronPython2; unwired: IN[0]
# ---------- input_check.python (8 lines) ----------
input = IN[0]
elements = []

if isinstance(input, list): 
	for i in input:	elements.append(i)
else: elements = [input]
		
OUT = elements
# ----------------------------------------
code_block = CodeBlock { "Sheets"; }
byName = Category.ByName(name=code_block)
all_elements_of_category = ElementsOfCategory(Category=byName)
views_2 = Python()  # IronPython2; unwired: IN[0]
# ---------- views_2.python (20 lines) ----------
# Load the Python Standard and DesignScript Libraries

import clr
clr.AddReference("RevitServices")
import RevitServices
from RevitServices.Persistence import DocumentManager

doc = DocumentManager.Instance.CurrentDBDocument

viewp = IN[0]

#get the views from viewports
views = []
if isinstance(viewp, list): 
	for i in viewp:
		views.append(doc.GetElement(UnwrapElement(i).ViewId))
else: views.append(doc.GetElement(UnwrapElement(viewp).ViewId))


OUT = views
# ----------------------------------------
wait_seconds = Python()  # IronPython2; unwired: IN[0], IN[1]
# ---------- wait_seconds.python (14 lines) ----------
import clr
clr.AddReference('ProtoGeometry')
from Autodesk.DesignScript.Geometry import *
#The inputs to this node will be stored as a list in the IN variable.
import time

dataEnteringNode = IN
data = IN[0]
sec = IN[1]

time.sleep(sec)

#Assign your output to the OUT variable
OUT = data
# ----------------------------------------
delete = Python(IN[0]=wait_seconds)  # IronPython2
# ---------- delete.python (51 lines) ----------
# Load the Python Standard and DesignScript Libraries
import sys
import clr
clr.AddReference('ProtoGeometry')
from Autodesk.DesignScript.Geometry import *
clr.AddReference("RevitServices")
import RevitServices
from RevitServices.Persistence import DocumentManager
from RevitServices.Transactions import TransactionManager


clr.AddReference('RevitAPI')
from Autodesk.Revit.DB import *
from Autodesk.Revit.DB import Transaction

doc = DocumentManager.Instance.CurrentDBDocument
uidoc=DocumentManager.Instance.CurrentUIApplication.ActiveUIDocument



viewp = []
if isinstance(IN[0], list): 
	for i in IN[0]: viewp.append(UnwrapElement(i))
else: viewp = UnwrapElement(IN[0])


TransactionManager.Instance.EnsureInTransaction(doc)
#get sheet id of viewports
if isinstance(viewp, list): sheet_from = doc.GetElement(viewp[0].SheetId)
else: sheet_from = doc.GetElement(viewp.SheetId)

#get the views from viewports
views = []
if isinstance(viewp, list): 
	for i in viewp:
		views.append(doc.GetElement(i.OwnerViewId))
else: views.append(doc.GetElement(viewp.OwnerViewId))


#delete viewports
if isinstance(viewp, list):
	for i in viewp:
		sheet_from.DeleteViewport(i)
else: sheet_from.DeleteViewport(viewp)


TransactionManager.Instance.TransactionTaskDone()



OUT = views
# ----------------------------------------
passthrough = Python(IN[0]=views_2, IN[1]=delete)  # IronPython2
# ---------- passthrough.python (7 lines) ----------
d = IN[0]
p = IN[1]

if p is not None: out = d
else: out = "wait"

OUT = out
# ----------------------------------------
watch = Watch(passthrough)
coordinates = Python()  # IronPython2; unwired: IN[0]
# ---------- coordinates.python (38 lines) ----------
#Copyright (c) mostafa el ayoubi ,  2019 , @data_shapes
#Data-Shapes www.data-shapes.io , mostafa.elayoubi@data-shapes.io
import clr
clr.AddReference('RevitAPI')
from Autodesk.Revit.DB import *
clr.AddReference('ProtoGeometry')
from Autodesk.DesignScript.Geometry import Point as dspt
clr.AddReference('RevitServices')
from RevitServices.Persistence import DocumentManager
doc = DocumentManager.Instance.CurrentDBDocument
output = []

clr.AddReference('RevitNodes')
import Revit
clr.ImportExtensions(Revit.GeometryConversion)

from RevitServices.Transactions import TransactionManager
TransactionManager.Instance.ForceCloseTransaction


def toList(input):
	if isinstance(input,list):
		return UnwrapElement(input)
	else:
		return [UnwrapElement(input)]

locs = []

vps = toList(IN[0])

for v in vps:
	try:
		locs.append(v.GetBoxCenter().ToPoint())
	except:
		locs.append(v.Point.ToPoint())
		

OUT = locs
# ----------------------------------------
watch_2 = Watch(coordinates)
create_viewport = Python(IN[0]=watch, IN[1]=watch_2)  # IronPython2
# ---------- create_viewport.python (32 lines) ----------
# Load the Python Standard and DesignScript Libraries
import sys
import clr
clr.AddReference('ProtoGeometry')
from Autodesk.DesignScript.Geometry import *
clr.AddReference("RevitServices")
import RevitServices
from RevitServices.Persistence import DocumentManager
from RevitServices.Transactions import TransactionManager


clr.AddReference('RevitAPI')
from Autodesk.Revit.DB import *
from Autodesk.Revit.DB import Transaction

doc = DocumentManager.Instance.CurrentDBDocument
uidoc=DocumentManager.Instance.CurrentUIApplication.ActiveUIDocument


sheet_to = doc.ActiveView

points = IN[1]

#get the views from viewports
views = UnwrapElement(IN[0])

for i in range(0,len(views)):
	Viewport.Create(doc, sheet_to.Id, views[i].Id, XYZ(points[i].X/304.8, points[i].Y/304.8, points[i].Z/304.8))

collector = FilteredElementCollector(doc).OfClass(Viewport).ToElements()

OUT = collector[-len(views):]
# ----------------------------------------
compare_two_lists = Python()  # IronPython2; unwired: IN[0], IN[1]
# ---------- compare_two_lists.python (13 lines) ----------
dates = IN[0]
dates_stay = IN[1]

outt = []
tt = []
m = []
for i in dates:
	for j in dates_stay:
		if i == j: m =True
	if m != True: outt.append(False)
	else: outt.append(True)

OUT = outt
# ----------------------------------------
code_block_2 = CodeBlock { "Views"; }
byName_2 = Category.ByName(name=code_block_2)
all_elements_of_category_2 = ElementsOfCategory(Category=byName_2)
string_from_object = FromObject(obj=all_elements_of_category_2)
remove_nulls_str_elements = Python(IN[0]=string_from_object, IN[1]=all_elements_of_category_2)  # IronPython2
# ---------- remove_nulls_str_elements.python (13 lines) ----------
x = IN[0]
y = IN[1]

z = []
f = []

for i in x:
	if "null" not in i: z.append(2>1)
	else: z.append(2<1)
for i in range(len(y)):
	if z[i]==True: f.append(y[i])

OUT= f
# ----------------------------------------
code_block_3 = CodeBlock { "View Name"; }
getParameterValueByName = Element.GetParameterValueByName(element=remove_nulls_str_elements, parameterName=code_block_3)
string_from_object_2 = FromObject(obj=getParameterValueByName)
code_block_4 = CodeBlock()
# ---------- code_block_4.designscript (7 lines) ----------
[
"First",
"First_Proposed",
"L1",
"Level 1",
"Level 1 Proposed"
];
# ----------------------------------------
comparator_top_bottom_priority = Python(IN[0]=string_from_object_2, IN[1]=code_block_4, IN[2]=remove_nulls_str_elements)  # "comparator Top->Bottom Priority (str,str,element)"; IronPython2
# ---------- comparator_top_bottom_priority.python (11 lines) ----------
x = IN[0]
y = IN[1]
z = IN[2]

f = []

for i in range(len(x)):
	for j in range(len(y)):
		if x[i].find(y[j])!=-1: f.append(z[i])
		
OUT = f
# ----------------------------------------
watch_3 = Watch(comparator_top_bottom_priority)
null_check = Python()  # IronPython2; unwired: IN[0], IN[1]
# ---------- null_check.python (12 lines) ----------
strings = IN[0]
list = IN[1]

elements = []


for a,b in zip(strings, list):	
	if a != "null":
		elements.append(b)

		
OUT = elements
# ----------------------------------------
active_view = Python()  # IronPython2; unwired: IN[0]
# ---------- active_view.python (14 lines) ----------
import clr

clr.AddReference("RevitServices")
import RevitServices
from RevitServices.Persistence import DocumentManager
from RevitServices.Transactions import TransactionManager
doc =  DocumentManager.Instance.CurrentDBDocument
app = DocumentManager.Instance.CurrentUIApplication.Application

clr.AddReference("RevitAPI")
from Autodesk.Revit.DB import *

View = doc.ActiveView
OUT = View
# ----------------------------------------
exec_ribbon_copy = Python()  # IronPython2; unwired: IN[0]
# ---------- exec_ribbon_copy.python (23 lines) ----------
import clr
clr.AddReference('RevitAPI')
clr.AddReference('RevitAPIUI')
import Autodesk
from Autodesk.Revit.UI import RevitCommandId
from Autodesk.Revit.UI import UIApplication
from Autodesk.Revit.UI import ExternalCommandData
clr.AddReference('RevitServices')
import RevitServices
from RevitServices.Persistence import DocumentManager



###to find a bloody command ID press the required button and then check 
###C:\Users\64210\AppData\Local\Autodesk\Revit\Autodesk Revit 2021\Journals  for txt journal file
if IN[0] != None:
	uiapp = DocumentManager.Instance.CurrentUIApplication
	CmndID = RevitCommandId.LookupCommandId('ID_EDIT_COPY')
	CmId = CmndID.Id
	uiapp.PostCommand(CmndID)
	OUT = "button is pressed"
#OUT = RevitCommandId.LookupPostableCommandId('CopyToClipboard')
else: OUT = "no button to press"
# ----------------------------------------
watch_4 = Watch(exec_ribbon_copy)
select_model_elements = DSModelElementsSelection()  # 1 picked in the model
watch_5 = Watch(select_model_elements)  # graph output
getCategory = Element.GetCategory(element=select_model_elements)
input_check_2 = Python(IN[0]=getCategory)  # IronPython2; same code as input_check
code_block_5 = CodeBlock { "Sheets"; }
byName_3 = Category.ByName(name=code_block_5)
category_filter = Python(IN[0]=input_check_2, IN[1]=byName_3)  # IronPython2
# ---------- category_filter.python (5 lines) ----------
for i in IN[0]:
	outt = []
	if i ==IN[1]:
		outt.append(i)
OUT = outt
# ----------------------------------------

# group: to exclude
code_block_6 = CodeBlock()
# ---------- code_block_6.designscript (6 lines) ----------
[
"Template",
"3D",
"USER ATTENTION",
"TEMPLATE"
];
# ----------------------------------------
comparator_to_excl_str_str = Python(IN[1]=code_block_6)  # "comparator to EXCL (str,str,element)"; IronPython2; unwired: IN[0], IN[2]
# ---------- comparator_to_excl_str_str.python (26 lines) ----------
x = IN[0]
y = IN[1]
z = IN[2]


#if you want to INCLUDE then swap jk.append(False) and jk.append(True)
jk = []
zf = []

for i in range(len(x)):
	for j in range(len(y)):
		if x[i].find(y[j])!=-1: 
			zf = True
	if zf == True:
		jk.append(False)
	else:
		jk.append(True)
	zf = []
	
ist = zip(z,jk)
kg = []
for i in ist:
	if i[1] ==True:
		kg.append(i[0])
	
OUT = kg
# ----------------------------------------

comparator_to_incl_str_str = Python(IN[1]=code_block_6)  # "comparator to INCL (str,str,element)"; IronPython2; unwired: IN[0], IN[2]
# ---------- comparator_to_incl_str_str.python (26 lines) ----------
x = IN[0]
y = IN[1]
z = IN[2]


#if you want to INCLUDE then swap jk.append(False) and jk.append(True)
jk = []
zf = []

for i in range(len(x)):
	for j in range(len(y)):
		if x[i].find(y[j])!=-1: 
			zf = True
	if zf == True:
		jk.append(True)
	else:
		jk.append(False)
	zf = []
	
ist = zip(z,jk)
kg = []
for i in ist:
	if i[1] ==True:
		kg.append(i[0])
	
OUT = kg
# ----------------------------------------
pop_up_message = Python()  # IronPython2; unwired: IN[0]
# ---------- pop_up_message.python (19 lines) ----------
#This script pops up a dialog box with a message from the previous node.
import clr
clr.AddReference('RevitAPIUI')

from Autodesk.Revit.UI import TaskDialog

ff = []
for i in IN[0]: ff.append(i + " \n")

mainText = "DELETED LIST: \n " + ''.join(i for i in ff)


if mainText != None and mainText != "null"  :
	messagePop = TaskDialog("Dynamo Player")
	messagePop.MainContent = mainText
	
	OUT = "Success!"
	
	messagePop.Show()
# ----------------------------------------
